# Grasshopper definition E+.gh (Grasshopper 1.0.7)

honeybee = Honeybee_Honeybee()  # -> Vviiiiiiiiiizzz; plug-in component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
ladybug = Ladybug_Ladybug()  # -> Vviiiiiiiiiizzz; plug-in component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
pipeline = GeometryPipeline(
    GroupByLayer=False,
    GroupByType=False,
    IncludeHidden=True,
    IncludeLocked=True,
    LayerFilter="Building",
    NameFilter="*",
    SublayerFiltering=True,
    TypeFilter=32)
pipeline_2 = GeometryPipeline(
    GroupByLayer=False,
    GroupByType=False,
    IncludeHidden=True,
    IncludeLocked=True,
    LayerFilter="Tree",
    NameFilter="*",
    SublayerFiltering=True,
    TypeFilter=32)

# ---- group: roof
srf = Surface(<surface referenced from the Rhino model>)

# ----
panel = Panel("Outdoors")

# ---- group: walls
srf_2 = Surface([<surface referenced from the Rhino model> x12])

# ---- group: exposed floor
srf_3 = Surface(<surface referenced from the Rhino model>)

# ----
epopaquemat = Honeybee_EnergyPlusOpaqueMaterial(name="barriere vap", thickness="0.001", conductivity="0.5", density="100", specificHeat="720")  # -> EPMaterial; plug-in component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

# ---- group: window
srf_4 = Surface([<surface referenced from the Rhino model> x4])

# ---- group: ground floor
srf_5 = Surface(<surface referenced from the Rhino model>)

# ----
epopaquemat_2 = Honeybee_EnergyPlusOpaqueMaterial(name="verre cellul", thickness="0.1", conductivity="0.064", density="120", specificHeat="1000")  # -> EPMaterial; plug-in component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

# ---- group: PV
srf_6 = Surface(<surface referenced from the Rhino model>)

# ----
epopaquemat_3 = Honeybee_EnergyPlusOpaqueMaterial(name="laine minerale", thickness="0.07", conductivity="0.04", density="50", specificHeat="850")  # -> EPMaterial; plug-in component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
epopaquemat_4 = Honeybee_EnergyPlusOpaqueMaterial(name="platre", thickness="0.012", conductivity="0.21", density="850", specificHeat="800")  # -> EPMaterial; plug-in component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
epnomassmat = Honeybee_EnergyPlusNoMassOpaqueMaterial(name="air gap", R_Value="0.183")  # -> EPMaterial; plug-in component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
epopaquemat_5 = Honeybee_EnergyPlusOpaqueMaterial(name="contre plaque", thickness="0.02", conductivity="0.12", density="700", specificHeat="1500")  # -> EPMaterial; plug-in component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
cluster = Cluster(G=pipeline)  # -> B, A, C, V
bbox = BoundingBox(Content=pipeline_2, Plane=PlaneXY(0, 0, 0))  # -> Box, Box_2
hb_epcontextsrf = HoneybeeEPContextSurfaces(shdSurfaces=flatten([cluster.B, bbox.Box]))  # -> HBContext; inputs shdSurfaces: list of Brep, justBoundingBox: Boolean
# ---------- hb_epcontextsrf: Python ----------
"""
prepare shading/context geometries

    Args:
        northVectorOrRotation: A vector that shows North or a number that shows
                               the rotation of the North from the Y axis
        bldgMasses: List of closed Breps as thermal zones.
    Returns:
        report: ...
        thermalZones: Thermal zone's geometries for visualiza
"""

ghenv.Component.Name = 'Honeybee EP context Surfaces'
ghenv.Component.NickName = 'HB_EPContextSrf'
ghenv.Component.Message = 'VER 0.0.64\nNOV_20_2018'
ghenv.Component.IconDisplayMode = ghenv.Component.IconDisplayMode.application
ghenv.Component.Category = "Honeybee"
ghenv.Component.SubCategory = "10 | Energy | Energy"
#compatibleHBVersion = VER 0.0.57\nNOV_04_2016
#compatibleLBVersion = VER 0.0.59\nFEB_01_2015
ghenv.Component.AdditionalHelpFromDocStrings = "2"

import rhinoscriptsyntax as rs
import Rhino as rc
import scriptcontext as sc
import os
import System
import Grasshopper.Kernel as gh
import uuid

tolerance = sc.doc.ModelAbsoluteTolerance
import math


def main(shdSurfaces, EPTransSchedule, meshingSettings, justBoundingBox):
    
    # import the classes
    if sc.sticky.has_key('honeybee_release'):

        try:
            if not sc.sticky['honeybee_release'].isCompatible(ghenv.Component): return -1
            if sc.sticky['honeybee_release'].isInputMissing(ghenv.Component): return -1
        except:
            warning = "You need a newer version of Honeybee to use this compoent." + \
            " Use updateHoneybee component to update userObjects.\n" + \
            "If you have already updated userObjects drag Honeybee_Honeybee component " + \
            "into canvas and try again."
            w = gh.GH_RuntimeMessageLevel.Warning
            ghenv.Component.AddRuntimeMessage(w, warning)
            return -1
        
        # don't customize this part
        hb_EPSrf = sc.sticky["honeybee_EPSurface"]
        hb_EPSHDSurface = sc.sticky["honeybee_EPShdSurface"]
        hb_RADMaterialAUX = sc.sticky["honeybee_RADMaterialAUX"]
        hb_EPObjectsAux = sc.sticky["honeybee_EPObjectsAUX"]()
        HBScheduleList = sc.sticky["honeybee_ScheduleLib"].keys()

        ########################################################################
        #----------------------------------------------------------------------#
        shdBreps = []
        # create bounding box of shading geometries
        if justBoundingBox:
            for brep in shdSurfaces:
                if brep.Faces.Count>1 or not brep.Faces[0].IsPlanar(sc.doc.ModelAbsoluteTolerance):
                    shdBreps.append(brep.GetBoundingBox(True).ToBrep())
                else:
                    shdBreps.append(brep)
        else:
            shdBreps = shdSurfaces
        
        shadingClasses = []
        shadingMeshPreview = []
        
        if meshingSettings == None:
            mp = rc.Geometry.MeshingParameters.Minimal
            mp.SimplePlanes = True
        else:
            mp = meshingSettings
        
        def getRadMaterialName(radMaterial):
            nameStr = radMaterial.split(" ")[2]
            name =  nameStr.split("\n")[0]
            return name
        
        for brepCount, brep in enumerate(shdBreps):
            if brep != None:
                isPlanar = True
                # check planarity
                for face in brep.Faces:
                    if not face.IsPlanar(tolerance):
                        isPlanar = False
                        break
                
                shadingBreps = []
                if not isPlanar:
                    meshArray = rc.Geometry.Mesh.CreateFromBrep(brep, mp)
                    for mesh in meshArray:
                        for meshFace in range(mesh.Faces.Count):
                            vertices = list(mesh.Faces.GetFaceVertices(meshFace))[1:]
                            vertices = vertices + [sc.doc.ModelAbsoluteTolerance]
                            # create the brep from mesh
                            shdBrep = rc.Geometry.Brep.CreateFromCornerPoints(*vertices)
                            shadingBreps.append(shdBrep)
                else:
                    for face in brep.Faces:
                        shadingBreps.append(face.DuplicateFace(False))
                
                for faceCount, shdBrep in enumerate(shadingBreps):
                        thisShading = hb_EPSHDSurface(shdBrep, 1000*brepCount + faceCount, 'shdSrf_' + `brepCount` + '_' + `faceCount` + "_" + str(uuid.uuid4()))
                        
                        # add transmittance schedule if any
                        if EPTransSchedule!=None:
                            schedule= EPTransSchedule.upper()
                            if schedule!=None and not schedule.lower().endswith(".csv") and schedule not in HBScheduleList:
                                msg = "Cannot find " + schedule + " in Honeybee schedule library."
                                print msg
                                ghenv.Component.AddRuntimeMessage(gh.GH_RuntimeMessageLevel.Warning, msg)
                                return -1
                            elif schedule!=None and schedule.lower().endswith(".csv"):
                                # check if csv file is existed
                                if not os.path.isfile(schedule):
                                    msg = "Cannot find the shchedule file: " + schedule
                                    print msg
                                    ghenv.Component.AddRuntimeMessage(gh.GH_RuntimeMessageLevel.Warning, msg)
                                    return -1
                            
                            thisShading.TransmittanceSCH = schedule
                        
                        # add the Rad Material if any
                        if RADMaterial!=None:
                            # if it is just the name of the material make sure it is already defined
                            if len(RADMaterial.split(" ")) == 1:
                                # if the material is not in the library add it to the library
                                if not hb_RADMaterialAUX.isMatrialExistInLibrary(RADMaterial):
                                    warningMsg = "Can't find " + RADMaterial + " in RAD Material Library.\n" + \
                                                "Add the material to the library and try again."
                                    ghenv.Component.AddRuntimeMessage(gh.GH_RuntimeMessageLevel.Warning, warningMsg)
                                    return
                                
                                try:
                                    thisShading.setRADMaterial(RADMaterial)
                                except Exception, e:
                                    print e
                                    warningMsg = "You are using an old version of Honeybee_Honeybee! Update your files and try again."
                                    print warningMsg
                                    ghenv.Component.AddRuntimeMessage(gh.GH_RuntimeMessageLevel.Warning, warningMsg)
                                    return
                                
                                addedToLib = True
                            else:
                                
                                # try to add the material to the library
                                addedToLib, thisShading.RadMaterial = hb_RADMaterialAUX.analyseRadMaterials(RADMaterial, True)
                                
                            if addedToLib==False:
                                warningMsg = "Failed to add " + RADMaterial + " to the Library."
                                ghenv.Component.AddRuntimeMessage(gh.GH_RuntimeMessageLevel.Warning, warningMsg)
                                return
                        
                        # add shading to the list
                        shadingClasses.append(thisShading)
                
        # add to the hive
        hb_hive = sc.sticky["honeybee_Hive"]()
        HBContext  = hb_hive.addToHoneybeeHive(shadingClasses, ghenv.Component)
        return HBContext
        ################################################################################################
    else:
        print "You should first let Honeybee to fly..."
        w = gh.GH_RuntimeMessageLevel.Warning
        ghenv.Component.AddRuntimeMessage(w, "You should first let Honeybee to fly...")
        return -1
        

if _shdSurfaces and _shdSurfaces[0]!=None:
    # add cleaning function
    result= main(_shdSurfaces, EPTransSchedule_, meshingSettings_, justBoundingBox_)
    
    if result != -1: HBContext = result
# ---------- end hb_epcontextsrf ----------
simple_inverter = Honeybee_simple_Inverter(inverterName="inverter", inverterCost="5300")  # -> readMe, HB_inverter; plug-in component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
num = Number("136")
epconstruction = Honeybee_EnergyPlusConstruction(
    name="envelope",
    layer_1=epopaquemat,
    layer_2=epopaquemat_2,
    layer_3=epopaquemat,
    layer_4=epopaquemat_3,
    layer_5=epnomassmat,
    layer_6=epopaquemat,
    layer_7=epopaquemat_5,
    layer_8=epopaquemat_4)  # -> EPConstruction; plug-in component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
createhbsrfs = Honeybee_createHBSrfs(geometry=srf, EPBC="Outdoors", EPConstruction=epconstruction)  # -> readMe, simplify(HBSurface); plug-in component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
createhbsrfs_2 = Honeybee_createHBSrfs(geometry=srf_3, EPBC="Outdoors", EPConstruction=epconstruction)  # -> readMe, simplify(HBSurface); plug-in component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
createhbsrfs_3 = Honeybee_createHBSrfs(geometry=srf_2, EPBC="Outdoors", EPConstruction=epconstruction)  # -> readMe, simplify(HBSurface); plug-in component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
createhbsrfs_4 = Honeybee_createHBSrfs(geometry=srf_5, EPBC="Ground", EPConstruction=epconstruction)  # -> readMe, simplify(HBSurface); plug-in component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
callfromepconstrlibrary = Honeybee_CallFromEPConstructionLibrary(keywords="exterior window")  # -> ThermMaterials, EPMaterials, EPWindowMaterials, EPConstructions; plug-in component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
decomposeepconstruction = Honeybee_DecomposeEPConstruction(cnstrName="envelope")  # -> materials, comments, UValue_SI, UValue_IP, RValue_SI, RValue_IP; plug-in component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
panel_2 = Panel("""window 1
window 2
window 3
window 4""")
createhbzones = Honeybee_createHBZones(
    name="pavilion",
    HBSurfaces=flatten([createhbsrfs.HBSurface, createhbsrfs_3.HBSurface, createhbsrfs_2.HBSurface, createhbsrfs_4.HBSurface]),
    isConditioned=True)  # -> readMe, HBZone; plug-in component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
pvgen = Honeybee_Generator_PV(
    name="pvs",
    HBSurfaces=flatten(createhbsrfs.HBSurface),
    cellsEfficiency=Slider(0.1, range=0..1),
    NoParallel=Slider(1, range=0..10),
    Noseries=Slider(38, range=0..100),
    powerOutputPerModule=num,
    PVInverter=simple_inverter.HB_inverter)  # -> readMe, PV_HBSurfaces; plug-in component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
panel_3 = Panel(decomposeepconstruction.RValue_SI)
addhbglz = Honeybee_addHBGlz(
    HBObj=createhbzones.HBZone,
    childSurfaces=flatten(srf_4),
    childSurfacesName=flatten(panel_2),
    EPConstructions=callfromepconstrlibrary.EPConstructions)  # -> HBObjWGLZ; plug-in component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
panel_4 = Panel(epconstruction)
bldgprograms = Honeybee_bldgPrograms({"Office": 0, "Retail": 1, "MidriseApartment": 2, "PrimarySchool": 3, "SecondarySchool": 4, "SmallHotel": 5, "LargeHotel": 6, "Hospital": 7, "Outpatient": 8, "Warehouse": 9, "SuperMarket": 10, "FullServiceRestaurant": 11, "QuickServiceRestaurant": 12}, selected="Retail")
decomposeepconstruction_2 = Honeybee_DecomposeEPConstruction(cnstrName=callfromepconstrlibrary.EPConstructions)  # -> materials, comments, UValue_SI, UValue_IP, RValue_SI, RValue_IP; plug-in component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
panel_5 = Panel(pvgen.readMe)
generationsystem = Honeybee_generationsystem(GeneratorSystemName="pvs", PVHBSurfaces=pvgen.PV_HBSurfaces)  # -> readMe, HBGeneratorSystem; plug-in component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
listzoneprograms = Honeybee_ListZonePrograms(bldgProgram=bldgprograms)  # -> RetailZonePrograms; plug-in component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
setloadsandschedules = Honeybee_SetLoadsAndSchedules(HBZones=flatten(addhbglz), zonePrograms=listzoneprograms)  # -> currentSchedules, currentLoads, HBZones; plug-in component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
hvacsystemslist = Honeybee_HVACSystemsList({"-1. Thermostat Only": -1, "0. Ideal Air Loads": 0, "1. PTAC | Residential": 1, "2. PTHP | Residential": 2, "3. Packaged Single Zone - AC": 3, "4. Packaged Single Zone - HP": 4, "5. Packaged VAV w/ Reheat": 5, "6. Packaged VAV w/ PFP Boxes": 6, "7. VAV w/ Reheat": 7, "8. VAV w/ PFP Boxes": 8, "9. Warm Air Furnace - Gas Fired": 9, "10.Warm Air Furnace - Electric": 10, "11.Fan Coil Units + DOAS": 11, "12.Active Chilled Beams + DOAS": 12, "13.Radiant Floors + DOAS": 13, "14.Custom Rad Surfaces + DOAS": 14, "15.Heated Surfaces + VAV Cooling": 15, "16.VRF + DOAS": 16, "17.WSHP + DOAS": 17}, selected="0. Ideal Air Loads")
panel_6 = Panel(setloadsandschedules.currentLoads)
hvacsystem = Honeybee_AssignHVACSystem(HBZones=flatten(setloadsandschedules.HBZones), HVACSystems=hvacsystemslist)  # -> readMe, HBZones; plug-in component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
hvacsystemslist_2 = Honeybee_HVACSystemsList({"-1. Thermostat Only": -1, "0. Ideal Air Loads": 0, "1. PTAC | Residential": 1, "2. PTHP | Residential": 2, "3. Packaged Single Zone - AC": 3, "4. Packaged Single Zone - HP": 4, "5. Packaged VAV w/ Reheat": 5, "6. Packaged VAV w/ PFP Boxes": 6, "7. VAV w/ Reheat": 7, "8. VAV w/ PFP Boxes": 8, "9. Warm Air Furnace - Gas Fired": 9, "10.Warm Air Furnace - Electric": 10, "11.Fan Coil Units + DOAS": 11, "12.Active Chilled Beams + DOAS": 12, "13.Radiant Floors + DOAS": 13, "14.Custom Rad Surfaces + DOAS": 14, "15.Heated Surfaces + VAV Cooling": 15, "16.VRF + DOAS": 16, "17.WSHP + DOAS": 17}, selected="17.WSHP + DOAS")
coolingdetails = Honeybee_HVACCoolingDetails()  # -> coolingDetails; plug-in component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
heatingdetails = Honeybee_HVACHeatingDetails()  # -> heatingDetails; plug-in component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
toggle = BooleanToggle(False)
airdetails = Honeybee_HVACAirDetails()  # -> airDetails; plug-in component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
simcontrol = Honeybee_SimulationControl(doSystemSizingCalculation=toggle, doPlantSizingCalculation=toggle, runSimForSizingPeriods=toggle)  # -> simControls; plug-in component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
series = Series(Start="1", Step=1, Count="105")
series_2 = Series(Start="350", Step=1, Count="15")
hvacsystem_2 = Honeybee_AssignHVACSystem(HBZones=flatten(hvacsystem.HBZones), HVACSystems=hvacsystemslist_2)  # -> readMe, HBZones; plug-in component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
merge = Merge(Data1=series, Data2=series_2)
int = Integer(merge)
toggle_2 = BooleanToggle(True)
energysimpar = Honeybee_EnergySimulationPar(timestep=6, solarDistribution=Slider(1, range=0..1), simulationControls=simcontrol)  # -> energySimPar; plug-in component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
panel_7 = Panel("https://www.energyplus.net/weather-download/europe_wmo_region_6/ITA//ITA_Venezia-Tessera.161050_IGDG/all")
panel_8 = Panel(int)
epoutput = Honeybee_GenerateEPOutput(zoneEnergyUse=toggle_2, zoneGainsAndLosses=toggle_2, zoneComfortMetrics="False", surfaceTempAnalysis="False")  # -> report, flatten(simulationOutputs); plug-in component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
analysisperiod = Ladybug_AnalysisPeriod()  # -> readMe, analysisPeriod; plug-in component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
epw_stat = Ladybug_OpenEPWAndSTATWeatherFiles(weatherFileURL=panel_7)  # -> epwFile, statFile; plug-in component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
toggle_3 = BooleanToggle(False)
toggle_4 = BooleanToggle(False)
Y = UnitY(Factor=1)
runenergysimulation = Honeybee_RunEnergySimulation(
    north=Y,
    epwFile=epw_stat.epwFile,
    analysisPeriod=analysisperiod.analysisPeriod,
    energySimPar=energysimpar,
    HBZones=flatten(hvacsystem.HBZones),
    HBContext=flatten(hb_epcontextsrf),
    HBGenerators=generationsystem.HBGeneratorSystem,
    simulationOutputs=flatten(epoutput.simulationOutputs),
    writeIdf=toggle_3,
    runEnergyPlus=toggle_3,
    idfFileName="pavilion")  # -> readMe, idfFileAddress, resultFileAddress, eioFileAddress, rddFileAddress, htmlReport, studyFolder; plug-in component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
exporttoopenstudio = Honeybee_ExportToOpenStudio(
    north=Y,
    epwWeatherFile=epw_stat.epwFile,
    analysisPeriod=analysisperiod.analysisPeriod,
    energySimPar=energysimpar,
    HBContext=flatten(hb_epcontextsrf),
    HBGenerators=flatten(generationsystem.HBGeneratorSystem),
    simulationOutputs=flatten(epoutput.simulationOutputs),
    writeOSM=toggle_4,
    runSimulation=toggle_4,
    openOpenStudio=toggle_4,
    fileName="pavilion1")  # -> readMe, osmFileAddress, idfFileAddress, resultFileAddress, eioFileAddress, rddFileAddress, htmlReport, studyFolder, model; plug-in component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
panel_9 = Panel(runenergysimulation.readMe)
path = FilePath("c:\ladybug\pavilion\EnergyPlus\pavilion.idf")
path_2 = FilePath("c:\ladybug\pavilion\EnergyPlus\pavilion.csv")
readep_analyse_generation_system_results = Honeybee_Read_generation_system_results(resultFileAddress=path_2, idfFileAddress=path)  # -> Readme, totalelectdemand, netpurchasedelect, generatorproducedenergy, financialdata; plug-in component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
readepresult = Honeybee_ReadEPResult(resultFileAddress=path_2)  # -> totalThermalLoad, thermalLoadBalance, cooling, heating, electricLight, electricEquip, port, port_2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; plug-in component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
energybalance = Honeybee_ConstructEnergyBalance(
    HBZones=flatten(hvacsystem.HBZones),
    cooling=readepresult.cooling,
    heating=readepresult.heating,
    electricLight=readepresult.electricLight,
    electricEquip=readepresult.electricEquip,
    peopleGains=readepresult.peopleGains,
    totalSolarGain=readepresult.totalSolarGain,
    infiltrationEnergy=readepresult.infiltrationEnergy,
    mechVentilationEnergy=readepresult.mechVentilationEnergy)  # -> readMe, port, flrNormEnergyBal, flrNormBalWStorage, port_2, modelEnergyBalance, energyBalWithStorage; plug-in component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
selectandaveragedata = Ladybug_AverageData(annualHourlyData=readep_analyse_generation_system_results.generatorproducedenergy, totalOrAverage=Toggle(True))  # -> readMe, selHourlyData, totaledDaily, totaledMonthly, totMonthlyPerHour, totMonthlyMinPerHour, totMonthlyMaxPerHour; plug-in component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
selectandaveragedata_2 = Ladybug_AverageData(annualHourlyData=readep_analyse_generation_system_results.totalelectdemand, totalOrAverage=Toggle(True))  # -> readMe, selHourlyData, totaledDaily, totaledMonthly, totMonthlyPerHour, totMonthlyMinPerHour, totMonthlyMaxPerHour; plug-in component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
readepsrfresult = Honeybee_ReadEPSurfaceResult()  # -> surfaceIndoorTemp, surfaceOutdoorTemp, surfaceEnergyFlow, opaqueEnergyFlow, glazEnergyFlow, windowTotalSolarEnergy, windowBeamEnergy, windowDiffEnergy, windowTransmissivity; plug-in component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
selectandaveragedata_3 = Ladybug_AverageData(annualHourlyData=energybalance.flrNormEnergyBal, totalOrAverage=Toggle(True))  # -> readMe, selHourlyData, totaledDaily, totaledMonthly, totMonthlyPerHour, totMonthlyMinPerHour, totMonthlyMaxPerHour; plug-in component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
selectandaveragedata_4 = Ladybug_AverageData(annualHourlyData=energybalance.modelEnergyBalance, totalOrAverage=Toggle(True))  # -> readMe, selHourlyData, totaledDaily, totaledMonthly, totMonthlyPerHour, totMonthlyMinPerHour, totMonthlyMaxPerHour; plug-in component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
gradientlibrary = Ladybug_GradientLibrary(gradIndex="19")  # -> customColors; plug-in component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
merge_2 = Merge(Data1=selectandaveragedata_2.totaledMonthly, Data2=selectandaveragedata.totaledMonthly)
panel_10 = Panel(selectandaveragedata_4.totaledMonthly)
legendpar = Ladybug_LegendParameters(customColors=flatten(gradientlibrary))  # -> legendPar; plug-in component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
panel_11 = Panel(merge_2)
strnum = Ladybug_SeparateData(inputList=flatten(selectandaveragedata_3.totaledMonthly))  # -> numbers, strings; plug-in component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
ma = MassAddition(Input=strnum.numbers)  # -> Result, PartialResults
barchart = Ladybug_MonthlyBarChart(
    inputData=flatten(selectandaveragedata_3.totaledMonthly),
    stackValues=Toggle(True),
    altYAxisTitle="energy [kWh/m2]",
    legendPar=legendpar)  # -> readMe, dataMesh, dataCurves, dataCrvColors, graphAxes, graphLabels, title, titleBasePt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; plug-in component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
barchart_2 = Ladybug_MonthlyBarChart(
    inputData=flatten([selectandaveragedata_2.totaledMonthly, selectandaveragedata.totaledMonthly]),
    stackValues=Toggle(False))  # -> readMe, dataMesh, dataCurves, dataCrvColors, graphAxes, graphLabels, title, titleBasePt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; plug-in component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
rep = ReplaceText(Text=strnum.strings, Find="Monthly", Replace="Yearly", RecursiveReplace=False)
merge_3 = Merge(Data1=rep, Data2=ma.Result)
panel_12 = Panel(merge_3)

# ==== cluster Cluster
G = ClusterInput()
project = Project(Geometry=G, Plane=PlaneXY(0, 0, 0))  # -> Geometry, Transform
bbox = BoundingBox(Content=G, Plane=PlaneXY(0, 0, 0))  # -> Box, Box_2
clean = CleanTree(RemoveNulls=True, RemoveInvalid=True, RemoveEmpty=False, Tree=project.Geometry)
debox = DeconstructBox(Box=bbox.Box)  # -> Plane, X, Y, Z
medges = MeshEdges(Mesh=clean)  # -> NakedEdges, InteriorEdges, NonManifoldEdges
dedomain = DeconstructDomain(Domain=debox.Z)  # -> Start, End
crv = Curve(medges.NakedEdges)
subtraction = Subtraction(A=dedomain.End, B=dedomain.Start)
join = JoinCurves(Curves=crv, Preserve=True)  # -> simplify(Curves)
larger = LargerThan(FirstNumber=subtraction, SecondNumber=0.01)  # -> LargerThan, OrEqualTo
cull = CullPattern(List=subtraction, CullPattern=larger.LargerThan)  # -> graft(List)
boundary = BoundarySurfaces(Edges=join)
Z = UnitZ(Factor=cull)  # -> simplify(UnitVector)
extr = Extrude(Base=boundary, Direction=Z)
area = Area(Geometry=extr)  # -> Area, Centroid
volume = MeshVolume(Mesh=extr)  # -> Volume, Centroid
cap = CapHoles(Brep=extr)
C = ClusterOutput(area.Centroid)
V = ClusterOutput(volume.Volume)
A = ClusterOutput(area.Area)
B = ClusterOutput(cap)
