# Grasshopper definition Heat Island_Berl.gh (Grasshopper 1.0.7)
# plug-ins: Human

# 2
toggle = BooleanToggle(True)

mesh = Mesh([<mesh referenced from the Rhino model> x27])
cluster = Cluster(C=mesh)

weather_file = Panel("https://energyplus.net/weather-download/europe_wmo_region_6/ITA//ITA_Venezia-Tessera.161050_IGDG/all")
epw_stat = Ladybug_OpenEPWAndSTATWeatherFiles(weatherFileURL=weather_file)  # -> epwFile, statFile; plug-in component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

# ---- group: Building Typologies
bldg_program = Dragonfly_bldgPrograms({"FullServiceRestaurant", "Hospital", "LargeHotel", "LargeOffice", "MediumOffice", "MidRiseApartment", "OutPatient", "PrimarySchool", "QuickServiceRestaurant", "SecondarySchool", "SmallHotel", "SmallOffice", "StandAloneRetail", "StripMall", "SuperMarket", "Warehouse"}, selected="StandAloneRetail")
bldg_age = Dragonfly_bldgAge({"Pre-1980's": "Pre1980s", "1980's-Present": "1980sPresent", "New Construction": "NewConstruction"}, selected="Pre-1980's")

# ----
# 1
toggle_2 = BooleanToggle(True)

tree_site_coverage_factor = Panel("0.61")
grass_site_coverage_factor = Panel("0.0")

# ---- group: Geometry Params
building_site_coverage_factor = Panel("0.14")

# ----
cluster_2 = Cluster_2(G=mesh)  # -> A, i, V
ma = MassAddition(Input=flatten(cluster_2.A))  # -> Result, PartialResults

dragonfly = DFDragonfly()  # -> Vviiiiiiiiiizzz; plug-in component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
ladybug = Ladybug_Ladybug()  # -> Vviiiiiiiiiizzz; plug-in component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

# ---- group: height and facade ratio calc
bbox = BoundingBox(Content=mesh, Plane=PlaneXY(0, 0, 0))  # -> Box, Box_2
project = Project(Geometry=bbox.Box, Plane=PlaneXY(0, 0, 0))  # -> Geometry, Transform
boxprop = BoxProperties(Box=bbox.Box)  # -> Center, Diagonal, Area, Volume, Degeneracy
debox = DeconstructBox(Box=bbox.Box)  # -> Plane, X, Y, Z
dedomain = DeconstructDomain(Domain=debox.Z)  # -> Start, End
area = Area(Geometry=project.Geometry)  # -> Area, Centroid
subtraction = Subtraction(A=dedomain.End, B=dedomain.Start)
expression = Expression(x=boxprop.Area, y=area.Area, Expression="x-2*y")
area_2 = Area(Geometry=cluster)  # -> Area, Centroid
ma_2 = MassAddition(Input=expression)  # -> Result, PartialResults
avr = Average(Input=subtraction)
division = Division(A=ma.Result, B=area_2.Area)

# ----
importstat = Ladybug_ImportStat(statFile=epw_stat.statFile)  # -> readMe, ashraeClimateZone, koppenClimateZone, heatingDesignTemps, coolingDesignTemps, heatingDesignDay, coolingDesignDay, monthlyTauBeam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; plug-in component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

# ----
# Define Urban Parameters
panel = Panel("0.2")
vegpar = DFVegetationParameters(albedo="0.45")  # -> vegetation_par; plug-in component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
pavementpar = DFPavementParameters(albedo=panel)  # -> pavement_par; plug-in component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
trafficpar = DFTrafficParameters(sensible_heat="2")  # -> traffic_par; plug-in component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

# ----
# Define the City
cityfrompar = DFCityFromParameters(
    avg_height=avr,
    site_coverage=building_site_coverage_factor,
    facade_to_site=division,
    bldg_programs=bldg_program,
    bldg_ages=bldg_age,
    bldg_ratios=Slider(1, range=0..1),
    tree_coverage=tree_site_coverage_factor,
    grass_coverage=grass_site_coverage_factor,
    climate_zone=importstat.ashraeClimateZone,
    traffic_par=trafficpar,
    vegetation_par=vegpar,
    pavement_par=pavementpar,
    run=toggle_2)  # -> read_me, DF_city; plug-in component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
dragonfly_city = Panel(cityfrompar.DF_city)

analysisperiod = Ladybug_AnalysisPeriod(fromMonth="7", toMonth="7")  # -> readMe, analysisPeriod; disabled; plug-in component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

# ----
# Run the UWG
runuwg = DFRunUrbanWeatherGenerator(
    epw_file=epw_stat.epwFile,
    city=cityfrompar.DF_city,
    analysis_period=analysisperiod.analysisPeriod,
    write=toggle,
    run=toggle)  # -> read_me, port, urban_epw, port_2, uwg_object; plug-in component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

# ----
# Visualize Results
importepw = Ladybug_ImportEpw(epwFile=epw_stat.epwFile)  # -> readMe, latitude, location, dryBulbTemperature, dewPointTemperature, relativeHumidity, windSpeed, windDirection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; plug-in component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
importepw_2 = Ladybug_ImportEpw(epwFile=runuwg.urban_epw)  # -> readMe, latitude, location, dryBulbTemperature, dewPointTemperature, relativeHumidity, windSpeed, windDirection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; plug-in component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
selectandaveragedata = Ladybug_AverageData(annualHourlyData=importepw_2.dryBulbTemperature, analysisPeriod=analysisperiod.analysisPeriod)  # -> readMe, selHourlyData, averagedDaily, averagedMonthly, avrMonthlyPerHour, avrMonthlyMinPerHour, avrMonthlyMaxPerHour; plug-in component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
selectandaveragedata_2 = Ladybug_AverageData(annualHourlyData=importepw.dryBulbTemperature, analysisPeriod=analysisperiod.analysisPeriod)  # -> readMe, selHourlyData, averagedDaily, averagedMonthly, avrMonthlyPerHour, avrMonthlyMinPerHour, avrMonthlyMaxPerHour; plug-in component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
legendpar = Ladybug_LegendParameters(lowBound="0", highBound="50", numSegments="11", fontSize=Slider(1.6, range=0..10))  # -> legendPar; plug-in component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
replace = ReplaceItems(List=selectandaveragedata.avrMonthlyPerHour, Item="Urban Temperature", Indices="2", Wrap=False)

replace_2 = ReplaceItems(List=selectandaveragedata_2.avrMonthlyPerHour, Item="Rural Temperature", Indices="2", Wrap=False)

barchart = Ladybug_MonthlyBarChart(
    inputData=flatten([replace_2, replace]),
    altYAxisTitle="Outdoor Air Temperature (°C)",
    xScale=Slider(0.6, range=0..1),
    legendPar=legendpar)  # -> readMe, dataMesh, dataCurves, dataCrvColors, graphAxes, graphLabels, title, titleBasePt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; plug-in component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
previewlw = CustomPreviewLineweights(Geometry=barchart.dataCurves, Shader=barchart.dataCrvColors, Thickness="3", Absolute=False)

# ==== cluster Cluster
C = ClusterInput()
bbox = BoundingBox(Content=C, Plane=PlaneXY(0, 0, 0), UnionBox=True)  # -> Box, Box_2
debrep = DeconstructBrep(Brep=bbox.Box)  # -> Faces, Edges, Vertices
area = Area(Geometry=debrep.Faces)  # -> Area, Centroid
pdecon = Deconstruct(Point=area.Centroid)  # -> XComponent, YComponent, ZComponent
bnd = Bounds(Numbers=pdecon.ZComponent)
dedomain = DeconstructDomain(Domain=bnd)  # -> Start, End
equals = Equality(FirstNumber=pdecon.ZComponent, SecondNumber=dedomain.Start)  # -> Equality, Inequality
cull = CullPattern(List=debrep.Faces, CullPattern=equals.Equality)
flip = Flip(Surface=cull)  # -> Surface, Result
S = ClusterOutput(flip.Surface)

# ==== cluster Cluster_2
G = ClusterInput()
project = Project(Geometry=G, Plane=PlaneXY(0, 0, 0))  # -> Geometry, Transform
bbox = BoundingBox(Content=G, Plane=PlaneXY(0, 0, 0))  # -> Box, Box_2
clean = CleanTree(RemoveNulls=True, RemoveInvalid=True, RemoveEmpty=False, Tree=project.Geometry)
debox = DeconstructBox(Box=bbox.Box)  # -> Plane, X, Y, Z
dedomain = DeconstructDomain(Domain=debox.Z)  # -> Start, End
faceb = FaceBoundaries(Mesh=clean)  # -> simplify(Boundaries)
subtraction = Subtraction(A=dedomain.End, B=dedomain.Start)
join = JoinCurves(Curves=faceb, Preserve=True)  # -> simplify(Curves)
larger = LargerThan(FirstNumber=subtraction, SecondNumber=0.01)  # -> LargerThan, OrEqualTo
cull = CullPattern(List=subtraction, CullPattern=larger.LargerThan)  # -> graft(List)
boundary = BoundarySurfaces(Edges=join)
Z = UnitZ(Factor=cull)  # -> simplify(UnitVector)
extr = Extrude(Base=boundary, Direction=Z)
area = Area(Geometry=extr)  # -> Area, Centroid
volume = MeshVolume(Mesh=extr)  # -> Volume, Centroid
item = ListItem(List=area.Centroid, Index=0, Wrap=True)  # -> flatten(Item)
ma = MassAddition(Input=volume.Volume)  # -> flatten(Result), PartialResults
ma_2 = MassAddition(Input=area.Area)  # -> flatten(Result), PartialResults
i = ClusterOutput(item)
V = ClusterOutput(ma.Result)
A = ClusterOutput(ma_2.Result)
