# Grasshopper definition SVF.gh (Grasshopper 0.9.76)
# plug-ins: Python Interpreter

ladybug = Ladybug_Ladybug()  # -> Vviiiiiiiiiizzz; plug-in component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
run = BooleanToggle(True)
mesh = Mesh([<mesh referenced from the Rhino model> x46])
cluster = Cluster(C=mesh)
gradientlibrary = Ladybug_GradientLibrary(gradIndex=Slider(0, range=0..100))  # -> customColors; plug-in component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
legendpar = Ladybug_LegendParameters(lowBound=Slider(0, range=0..100), highBound=Slider(100, range=0..100), customColors=flatten(gradientlibrary))  # -> legendPar; plug-in component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
toggle = BooleanToggle(True)
viewanalysis = Ladybug_ViewAnalysis(
    geometry=flatten(cluster),
    context=flatten(mesh),
    gridSize=Slider(3, range=0..10),
    disFromBase=Slider(0.1, range=0..0.1),
    viewTypeOrPoints=flatten(Slider(4, range=0..10)),
    geometryBlocksView=toggle,
    legendPar=flatten(legendpar),
    parallel=toggle,
    runIt=run)  # -> readMe, contextMesh, analysisMesh, testPts, testVec, viewVec, port, viewStudyResult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; plug-in component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

# ==== cluster Cluster
C = ClusterInput()
bbox = BoundingBox(Content=C, Plane=PlaneXY(0, 0, 0), UnionBox=True)  # -> Box, Box_2
debrep = DeconstructBrep(Brep=bbox.Box)  # -> Faces, Edges, Vertices
area = Area(Geometry=debrep.Faces)  # -> Area, Centroid
pdecon = Deconstruct(Point=area.Centroid)  # -> XComponent, YComponent, ZComponent
bnd = Bounds(Numbers=pdecon.ZComponent)
dedomain = DeconstructDomain(Domain=bnd)  # -> Start, End
equals = Equality(FirstNumber=pdecon.ZComponent, SecondNumber=dedomain.Start)  # -> Equality, Inequality
cull = CullPattern(List=debrep.Faces, CullPattern=equals.Equality)
flip = Flip(Surface=cull)  # -> Surface, Result
S = ClusterOutput(flip.Surface)
