# Grasshopper definition carrier.gh (Grasshopper 0.9.76)
# plug-ins: Python Interpreter

ladybug = Ladybug_Ladybug()  # -> Vviiiiiiiiiizzz; plug-in component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
honeybee = Honeybee_Honeybee()  # -> Vviiiiiiiiiizzz; plug-in component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
run = BooleanToggle(True)
path = FilePath("C:\Users\Pietro.000\Desktop\Venise\ITA_Venezia-Tessera.161050_IGDG.epw")
importepw = Ladybug_ImportEpw(epwFile=path)  # -> readMe, latitude, location, dryBulbTemperature, dewPointTemperature, relativeHumidity, windSpeed, windDirection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; plug-in component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
pmvcomfortpar = Ladybug_PMVComfortParameters(PPDComfortThreshold=Slider(10, range=0..100), humidRatioUpBound=Slider(0.012, range=0..0.1))  # -> comfortPar; plug-in component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
legendpar = Ladybug_LegendParameters(lowBound=Slider(0, range=0..100), highBound=Slider(100, range=0..100), fontSize=Slider(1, range=0..10))  # -> legendPar; plug-in component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
activity = Panel("Standing")
clothing_level = Panel("""0.5
1""")
psychchart = Ladybug_PsychrometricChart(
    dryBulbTemperature=importepw.dryBulbTemperature,
    relativeHumidity=importepw.relativeHumidity,
    barometricPressure=importepw.barometricPressure,
    metabolicRate=activity,
    clothingLevel=clothing_level,
    comfortPar=pmvcomfortpar,
    mollierHX=Toggle(False),
    legendPar=legendpar,
    runIt=run)  # -> readMe, port, totalComfortPercent, totalComfortOrNot, strategyNames, strategyPercentOfTime, strategyOrNot, port_2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; plug-in component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
round = Round(Number=psychchart.totalComfortPercent)  # -> Nearest, Floor, Ceiling
bbox = BoundingBox(Content=psychchart.comfortPolygons, Plane=PlaneXY(0, 0, 0), UnionBox=True)  # -> Box, Box_2
area = Area(Geometry=bbox.Box)  # -> Area, Centroid
concat = Concatenate(FragmentA=round.Nearest, FragmentB="% comf")
tag = TextTag3D(Location=area.Centroid, Text=concat, Size=Slider(2.5, range=0..10), Colour="black", Justification=7)
