# Grasshopper definition compactness.gh (Grasshopper 0.9.76)

mesh = Mesh([<mesh referenced from the Rhino model> x46])
cluster = Cluster_2(G=mesh)  # -> A, C, V
cluster_2 = Cluster(C=mesh)
area = Area(Geometry=cluster_2)  # -> Area, Centroid
ma = MassAddition(Input=flatten(cluster.A))  # -> Result, PartialResults
ma_2 = MassAddition(Input=flatten(cluster.V))  # -> Result, PartialResults
division = Division(A=ma.Result, B=ma_2.Result)
division_2 = Division(A=cluster.A, B=cluster.V)
expression = Expression(x=division, Expression="Round(x,2)")
expression_2 = Expression(x=division_2, Expression="Round(x,2)")
s_v_per_building = Panel(expression_2)
overall_s_v = Panel(expression)
tag = TextTag3D(Location=area.Centroid, Text=expression, Size=Slider(8, range=0..10), Colour="red", Justification=7)
tag_2 = TextTag3D(Location=cluster.C, Text=expression_2, Size=Slider(5, range=0..10), Colour="black", Justification=7)

# ==== cluster Cluster
C = ClusterInput()
bbox = BoundingBox(Content=C, Plane=PlaneXY(0, 0, 0), UnionBox=True)  # -> Box, Box_2
debrep = DeconstructBrep(Brep=bbox.Box)  # -> Faces, Edges, Vertices
area = Area(Geometry=debrep.Faces)  # -> Area, Centroid
pdecon = Deconstruct(Point=area.Centroid)  # -> XComponent, YComponent, ZComponent
bnd = Bounds(Numbers=pdecon.ZComponent)
dedomain = DeconstructDomain(Domain=bnd)  # -> Start, End
equals = Equality(FirstNumber=pdecon.ZComponent, SecondNumber=dedomain.Start)  # -> Equality, Inequality
cull = CullPattern(List=debrep.Faces, CullPattern=equals.Equality)
flip = Flip(Surface=cull)  # -> Surface, Result
S = ClusterOutput(flip.Surface)

# ==== cluster Cluster_2
G = ClusterInput()
project = Project(Geometry=G, Plane=PlaneXY(0, 0, 0))  # -> Geometry, Transform
bbox = BoundingBox(Content=G, Plane=PlaneXY(0, 0, 0))  # -> Box, Box_2
clean = CleanTree(RemoveNulls=True, RemoveInvalid=True, RemoveEmpty=False, Tree=project.Geometry)
debox = DeconstructBox(Box=bbox.Box)  # -> Plane, X, Y, Z
medges = MeshEdges(Mesh=clean)  # -> NakedEdges, InteriorEdges, NonManifoldEdges
dedomain = DeconstructDomain(Domain=debox.Z)  # -> Start, End
crv = Curve(medges.NakedEdges)
subtraction = Subtraction(A=dedomain.End, B=dedomain.Start)
join = JoinCurves(Curves=crv, Preserve=True)  # -> simplify(Curves)
larger = LargerThan(FirstNumber=subtraction, SecondNumber=0.01)  # -> LargerThan, OrEqualTo
cull = CullPattern(List=subtraction, CullPattern=larger.LargerThan)  # -> graft(List)
boundary = BoundarySurfaces(Edges=join)
Z = UnitZ(Factor=cull)  # -> simplify(UnitVector)
extr = Extrude(Base=boundary, Direction=Z)
area = Area(Geometry=extr)  # -> Area, Centroid
volume = MeshVolume(Mesh=extr)  # -> Volume, Centroid
C = ClusterOutput(area.Centroid)
V = ClusterOutput(volume.Volume)
A = ClusterOutput(area.Area)
