# Grasshopper definition detailed radiation.gh (Grasshopper 1.0.7)

# ---- group: context
pipeline = GeometryPipeline(
    GroupByLayer=False,
    GroupByType=False,
    IncludeHidden=True,
    IncludeLocked=True,
    LayerFilter="mesh",
    NameFilter="*",
    SublayerFiltering=True,
    TypeFilter=32)

# ---- group: EPW data
path = FilePath("E:\Google Drive\Casa\Picco\3D Google\ITA_Torino-Caselle.160590_IGDG.epw")

# ---- group: base surface for panels
srf = Surface(<surface referenced from the Rhino model>)

# ---- group: mesh to project base surface onto
mesh = Mesh(<mesh referenced from the Rhino model>)

# ----
honeybee = Honeybee_Honeybee()  # -> Vviiiiiiiiiizzz; plug-in component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
ladybug = Ladybug_Ladybug()  # -> Vviiiiiiiiiizzz; plug-in component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
area = Area(Geometry=srf)  # -> Area, Centroid
Z = UnitZ(Factor=1)
meshray = MeshRay(Mesh=mesh, Point=area.Centroid, Direction=Z)  # -> Point, Hit
dist_from_base_mesh = Slider(0.1, range=0..1)
vec2pt = Vector2Pt(PointA=area.Centroid, PointB=meshray.Point, Unitize=False)  # -> Vector, Length
move = Move(Geometry=srf, Motion=vec2pt.Vector)  # -> Geometry, Transform
Z_2 = UnitZ(Factor=dist_from_base_mesh)
move_2 = Move(Geometry=move.Geometry, Motion=Z_2)  # -> Geometry, Transform

# ---- group: base plan
srf_2 = Surface(move_2.Geometry)

# ----
moduleactiveareapercent = Slider(93, range=0..100)
moduleefficiency = Slider(19.4, range=0..100)
temperature_coefficient = Panel("-0.258")

# ---- group: Module details
simplifiedphotovoltaicsmodule = Ladybug_SimplifiedPhotovoltaicsModule(
    mountType=1,
    moduleEfficiency=moduleefficiency,
    temperatureCoefficient=temperature_coefficient,
    moduleActiveAreaPercent=moduleactiveareapercent)  # -> readMe, PVmoduleSettings; plug-in component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

# ----
tilt_check_optimal_above = Panel("0")
azimuth_check_optimal_above = Panel("-145")

# ---- group: kWp
# PV System data
number_slider = Slider(3.25, range=0..10)

# ---- group: anchor point for array
md_slider = MDSlider(
    SliderMode=0,
    slider_value=Point(1, 0.4695121951, 0.5),
    x_domain=Domain(0, 1),
    y_domain=Domain(0, 1),
    z_domain=Domain(0, 1))

# ---- group: optimal exposure diagram
tof = Ladybug_TiltAndOrientationFactor(epwFile=path, PV_SWHsurface=srf_2, annualShading=0, north=0, precision=20, scale=1, bakeIt=False, runIt=Toggle(True))  # -> readMe, port, TOF, TSRF, PVsurfaceTilt, PVsurfaceAzimuth, optimalTilt, optimalAzimuth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; plug-in component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

# ----
modules_details = Panel(simplifiedphotovoltaicsmodule.readMe)
optimal_tilt = Panel(tof.optimalTilt)
optimal_azimuth = Panel(tof.optimalAzimuth)
importlocation = Ladybug_ImportLocation(epwFile=path)  # -> location; plug-in component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
tiltedarrayheight = Slider(1.59, range=0..10)

# ---- group: panels surface
pv_swh_systemsize = Ladybug_PVSWHSystemSize(
    location=importlocation,
    PVmoduleSettings=simplifiedphotovoltaicsmodule.PVmoduleSettings,
    systemSize=number_slider,
    arrayTiltAngle=tilt_check_optimal_above,
    arrayAzimuthAngle=azimuth_check_optimal_above,
    tiltedArrayHeight=tiltedarrayheight,
    numberOfRows=Slider(3, range=0..10),
    skewRowsDistance=0,
    baseSurface=srf_2,
    arrayOriginPt=md_slider,
    arrayOriginCorner=0,
    north=0)  # -> readMe, PV_SWHsurface, PV_SWHsurfacesArea, minimalSpacing, minimalSpacingDate, arrayOriginPt, energyLoadPerRowPerHour; plug-in component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

# ----
installation_data_summary = Panel(pv_swh_systemsize.readMe)

# ---- group: virtual energy produced by PV surface excluding shading
photovoltaicssurface = Ladybug_PhotovoltaicsSurface(
    epwFile=path,
    PVsurface=graft(pv_swh_systemsize.PV_SWHsurface),
    PVsurfacePercent=100,
    DCtoACderateFactor=0.85,
    PVmoduleSettings=simplifiedphotovoltaicsmodule.PVmoduleSettings,
    north=0,
    runIt=Toggle(True))  # -> readMe, port, ACenergyPerHour, ACenergyPerYear, averageDailyACenergyPerYear, port_2, DCenergyPerHour, totalRadiationPerHour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; plug-in component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

# ----
legendpar = Ladybug_LegendParameters(fontSize="0.1")  # -> legendPar; plug-in component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

# ---- group: shading sky map
sunpathshading = Ladybug_SunpathShading(
    epwFile=path,
    analysisGeometry=graft(pv_swh_systemsize.PV_SWHsurface),
    context=flatten(pipeline),
    coniferousAllyearIndex=0.3,
    deciduousInleafIndex=0.23,
    deciduousLeaflessIndex=0.64,
    ACenergyPerHour=photovoltaicssurface.ACenergyPerHour,
    north=0,
    outputGeometryIndex=0,
    scale=Slider(0.5, range=0..1),
    hoursPositionScale="0.1",
    precision=20,
    legendPar=legendpar,
    bakeIt=False,
    runIt=Toggle(True))  # -> readMe, skyExposureFactor, beamIndexPerHour, shadedSolarRadiationPerHour, port, Sep21toMar21Shading, Mar21toSep21Shading, annualShading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; plug-in component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

# ---- group: inverter efficiency corrected by shading
dctoacderatefactor = Ladybug_DCToACDerateFactor(
    annualShading=sunpathshading.annualShading,
    age=0,
    snow=0,
    wiring=2,
    soiling=2,
    mismatch=2,
    availability=3,
    connections=0.5,
    nameplateRating=1,
    lightInducedDegradation=1.5)  # -> readMe, totalLosses, DCtoACderateFactor; plug-in component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

# ----
panel = Panel(dctoacderatefactor.DCtoACderateFactor)
panel_2 = Panel(dctoacderatefactor.readMe)

# ---- group: actual production inclusive of shading and BOS
photovoltaicssurface_2 = Ladybug_PhotovoltaicsSurface(
    epwFile=path,
    PVsurface=graft(pv_swh_systemsize.PV_SWHsurface),
    PVsurfacePercent=100,
    DCtoACderateFactor=dctoacderatefactor.DCtoACderateFactor,
    PVmoduleSettings=simplifiedphotovoltaicsmodule.PVmoduleSettings,
    north=0,
    runIt=Toggle(True))  # -> readMe, port, ACenergyPerHour, ACenergyPerYear, averageDailyACenergyPerYear, port_2, DCenergyPerHour, totalRadiationPerHour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; plug-in component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

# ----
total_ac_production_per_row = Panel(photovoltaicssurface_2.ACenergyPerYear)
average_daily_production_per_row = Panel(photovoltaicssurface_2.averageDailyACenergyPerYear)

# ---- group: grand total AC production time breakdown
selectandaveragedata = Ladybug_AverageData(annualHourlyData=photovoltaicssurface_2.ACenergyPerHour, totalOrAverage=Toggle(True))  # -> readMe, selHourlyData, totaledDaily, totaledMonthly, totMonthlyPerHour, totMonthlyMinPerHour, totMonthlyMaxPerHour; plug-in component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

# ----
ma = MassAddition(Input=flatten(average_daily_production_per_row))  # -> Result, PartialResults
ma_2 = MassAddition(Input=flatten(total_ac_production_per_row))  # -> Result, PartialResults
daily_ac_production = Panel(ma.Result)
grand_total_ac_production = Panel(ma_2.Result)
barchart = Ladybug_MonthlyBarChart(inputData=flatten(selectandaveragedata.totaledMonthly), xScale=Slider(0.7, range=0..1))  # -> readMe, dataMesh, dataCurves, dataCrvColors, graphAxes, graphLabels, title, titleBasePt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; plug-in component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
