# Grasshopper definition natural light.gh (Grasshopper 1.0.7)
# plug-ins: Ironbug.LBHB_Legacy, Archsim

pt = Point(<point referenced from the Rhino model>)
pt_2 = Point(<point referenced from the Rhino model>)
pt_3 = Point(<point referenced from the Rhino model>)
pt_4 = Point(<point referenced from the Rhino model>)
pt_5 = Point(<point referenced from the Rhino model>)
pt_6 = Point(<point referenced from the Rhino model>)
pt_7 = Point(<point referenced from the Rhino model>)
pt_8 = Point(<point referenced from the Rhino model>)
pt_9 = Point(<point referenced from the Rhino model>)
pt_10 = Point(<point referenced from the Rhino model>)
pt_11 = Point(<point referenced from the Rhino model>)
pt_12 = Point(<point referenced from the Rhino model>)
pt_13 = Point(<point referenced from the Rhino model>)
pt_14 = Point(<point referenced from the Rhino model>)
pt_15 = Point(<point referenced from the Rhino model>)
pt_16 = Point(<point referenced from the Rhino model>)
pt_17 = Point(<point referenced from the Rhino model>)
pt_18 = Point(<point referenced from the Rhino model>)
pt_19 = Point(<point referenced from the Rhino model>)
pt_20 = Point(<point referenced from the Rhino model>)
pt_21 = Point(<point referenced from the Rhino model>)
pt_22 = Point(<point referenced from the Rhino model>)
pt_23 = Point(<point referenced from the Rhino model>)
pt_24 = Point(<point referenced from the Rhino model>)
pt_25 = Point(<point referenced from the Rhino model>)
pt_26 = Point(<point referenced from the Rhino model>)
pt_27 = Point(<point referenced from the Rhino model>)
pt_28 = Point(<point referenced from the Rhino model>)
pt_29 = Point(<point referenced from the Rhino model>)
pt_30 = Point(<point referenced from the Rhino model>)
pt_31 = Point(<point referenced from the Rhino model>)
pt_32 = Point(<point referenced from the Rhino model>)
pt_33 = Point(<point referenced from the Rhino model>)
pt_34 = Point(<point referenced from the Rhino model>)
pt_35 = Point(<point referenced from the Rhino model>)
pt_36 = Point(<point referenced from the Rhino model>)
pt_37 = Point(<point referenced from the Rhino model>)
pt_38 = Point(<point referenced from the Rhino model>)
pt_39 = Point(<point referenced from the Rhino model>)
pt_40 = Point(<point referenced from the Rhino model>)
pt_41 = Point(<point referenced from the Rhino model>)
pt_42 = Point(<point referenced from the Rhino model>)
pt_43 = Point(<point referenced from the Rhino model>)
pt_44 = Point(<point referenced from the Rhino model>)
pt_45 = Point(<point referenced from the Rhino model>)
pt_46 = Point(<point referenced from the Rhino model>)
pt_47 = Point(<point referenced from the Rhino model>)
pt_48 = Point(<point referenced from the Rhino model>)
pt_49 = Point(<point referenced from the Rhino model>)
pt_50 = Point(<point referenced from the Rhino model>)
pt_51 = Point(<point referenced from the Rhino model>)
pt_52 = Point(<point referenced from the Rhino model>)
pt_53 = Point(<point referenced from the Rhino model>)
pt_54 = Point(<point referenced from the Rhino model>)
pt_55 = Point(<point referenced from the Rhino model>)
pt_56 = Point(<point referenced from the Rhino model>)
pt_57 = Point(<point referenced from the Rhino model>)
pt_58 = Point(<point referenced from the Rhino model>)
pt_59 = Point(<point referenced from the Rhino model>)
pt_60 = Point(<point referenced from the Rhino model>)
pt_61 = Point(<point referenced from the Rhino model>)
pt_62 = Point(<point referenced from the Rhino model>)
pt_63 = Point(<point referenced from the Rhino model>)
pt_64 = Point(<point referenced from the Rhino model>)
pt_65 = Point(<point referenced from the Rhino model>)
pt_66 = Point(<point referenced from the Rhino model>)
pt_67 = Point(<point referenced from the Rhino model>)
pt_68 = Point(<point referenced from the Rhino model>)
pt_69 = Point(<point referenced from the Rhino model>)
pt_70 = Point(<point referenced from the Rhino model>)
pt_71 = Point(<point referenced from the Rhino model>)
pt_72 = Point(<point referenced from the Rhino model>)
pt_73 = Point(<point referenced from the Rhino model>)
pt_74 = Point(<point referenced from the Rhino model>)
pt_75 = Point(<point referenced from the Rhino model>)
pt_76 = Point(<point referenced from the Rhino model>)
pt_77 = Point(<point referenced from the Rhino model>)
pt_78 = Point(<point referenced from the Rhino model>)
pt_79 = Point(<point referenced from the Rhino model>)
pt_80 = Point(<point referenced from the Rhino model>)
pt_81 = Point(<point referenced from the Rhino model>)
pt_82 = Point(<point referenced from the Rhino model>)
pt_83 = Point(<point referenced from the Rhino model>)
pt_84 = Point(<point referenced from the Rhino model>)
pt_85 = Point(<point referenced from the Rhino model>)
pt_86 = Point(<point referenced from the Rhino model>)
pt_87 = Point(<point referenced from the Rhino model>)
pt_88 = Point(<point referenced from the Rhino model>)
pt_89 = Point(<point referenced from the Rhino model>)
pt_90 = Point(<point referenced from the Rhino model>)
pt_91 = Point(<point referenced from the Rhino model>)
pt_92 = Point(<point referenced from the Rhino model>)
pt_93 = Point(<point referenced from the Rhino model>)
pt_94 = Point(<point referenced from the Rhino model>)
pt_95 = Point(<point referenced from the Rhino model>)
pt_96 = Point(<point referenced from the Rhino model>)
vec2pt = Vector2Pt(PointA=pt_26, PointB=pt_19, Unitize=False)  # -> Vector, Length
vec2pt_2 = Vector2Pt(PointA=pt_27, PointB=pt_28, Unitize=False)  # -> Vector, Length
vec2pt_3 = Vector2Pt(PointA=pt_49, PointB=pt_38, Unitize=False)  # -> Vector, Length
vec2pt_4 = Vector2Pt(PointA=pt_59, PointB=pt_53, Unitize=False)  # -> Vector, Length
vec2pt_5 = Vector2Pt(PointA=pt_60, PointB=pt_61, Unitize=False)  # -> Vector, Length
vec2pt_6 = Vector2Pt(PointA=pt_63, PointB=pt_64, Unitize=False)  # -> Vector, Length
vec2pt_7 = Vector2Pt(PointA=pt_2, PointB=pt_58, Unitize=False)  # -> Vector, Length
vec2pt_8 = Vector2Pt(PointA=pt_71, PointB=pt_62, Unitize=False)  # -> Vector, Length
vec2pt_9 = Vector2Pt(PointA=pt_3, PointB=pt_4, Unitize=False)  # -> Vector, Length
vec2pt_10 = Vector2Pt(PointA=pt_9, PointB=pt_33, Unitize=False)  # -> Vector, Length
vec2pt_11 = Vector2Pt(PointA=pt_5, PointB=pt_14, Unitize=False)  # -> Vector, Length
vec2pt_12 = Vector2Pt(PointA=pt_7, PointB=pt_8, Unitize=False)  # -> Vector, Length
vec2pt_13 = Vector2Pt(PointA=pt_10, PointB=pt_11, Unitize=False)  # -> Vector, Length
vec2pt_14 = Vector2Pt(PointA=pt_6, PointB=pt_12, Unitize=False)  # -> Vector, Length
vec2pt_15 = Vector2Pt(PointA=pt_17, PointB=pt_18, Unitize=False)  # -> Vector, Length
vec2pt_16 = Vector2Pt(PointA=pt_13, PointB=pt_25, Unitize=False)  # -> Vector, Length
vec2pt_17 = Vector2Pt(PointA=pt_20, PointB=pt_29, Unitize=False)  # -> Vector, Length
vec2pt_18 = Vector2Pt(PointA=pt_15, PointB=pt_32, Unitize=False)  # -> Vector, Length
vec2pt_19 = Vector2Pt(PointA=pt_16, PointB=pt_24, Unitize=False)  # -> Vector, Length
vec2pt_20 = Vector2Pt(PointA=pt_22, PointB=pt_30, Unitize=False)  # -> Vector, Length
vec2pt_21 = Vector2Pt(PointA=pt, PointB=pt_52, Unitize=False)  # -> Vector, Length
vec2pt_22 = Vector2Pt(PointA=pt_23, PointB=pt_31, Unitize=False)  # -> Vector, Length
vec2pt_23 = Vector2Pt(PointA=pt_21, PointB=pt_51, Unitize=False)  # -> Vector, Length
vec2pt_24 = Vector2Pt(PointA=pt_35, PointB=pt_36, Unitize=False)  # -> Vector, Length
vec2pt_25 = Vector2Pt(PointA=pt_37, PointB=pt_48, Unitize=False)  # -> Vector, Length
vec2pt_26 = Vector2Pt(PointA=pt_41, PointB=pt_42, Unitize=False)  # -> Vector, Length
vec2pt_27 = Vector2Pt(PointA=pt_34, PointB=pt_45, Unitize=False)  # -> Vector, Length
vec2pt_28 = Vector2Pt(PointA=pt_46, PointB=pt_47, Unitize=False)  # -> Vector, Length
vec2pt_29 = Vector2Pt(PointA=pt_39, PointB=pt_50, Unitize=False)  # -> Vector, Length
vec2pt_30 = Vector2Pt(PointA=pt_43, PointB=pt_44, Unitize=False)  # -> Vector, Length
vec2pt_31 = Vector2Pt(PointA=pt_54, PointB=pt_55, Unitize=False)  # -> Vector, Length
vec2pt_32 = Vector2Pt(PointA=pt_56, PointB=pt_67, Unitize=False)  # -> Vector, Length
vec2pt_33 = Vector2Pt(PointA=pt_40, PointB=pt_72, Unitize=False)  # -> Vector, Length
vec2pt_34 = Vector2Pt(PointA=pt_57, PointB=pt_68, Unitize=False)  # -> Vector, Length
vec2pt_35 = Vector2Pt(PointA=pt_69, PointB=pt_70, Unitize=False)  # -> Vector, Length
vec2pt_36 = Vector2Pt(PointA=pt_65, PointB=pt_66, Unitize=False)  # -> Vector, Length
vec2pt_37 = Vector2Pt(PointA=pt_75, PointB=pt_77, Unitize=False)  # -> Vector, Length
vec2pt_38 = Vector2Pt(PointA=pt_81, PointB=pt_76, Unitize=False)  # -> Vector, Length
vec2pt_39 = Vector2Pt(PointA=pt_85, PointB=pt_93, Unitize=False)  # -> Vector, Length
vec2pt_40 = Vector2Pt(PointA=pt_82, PointB=pt_89, Unitize=False)  # -> Vector, Length
vec2pt_41 = Vector2Pt(PointA=pt_83, PointB=pt_90, Unitize=False)  # -> Vector, Length
vec2pt_42 = Vector2Pt(PointA=pt_84, PointB=pt_91, Unitize=False)  # -> Vector, Length
vec2pt_43 = Vector2Pt(PointA=pt_73, PointB=pt_74, Unitize=False)  # -> Vector, Length
vec2pt_44 = Vector2Pt(PointA=pt_86, PointB=pt_94, Unitize=False)  # -> Vector, Length
vec2pt_45 = Vector2Pt(PointA=pt_79, PointB=pt_80, Unitize=False)  # -> Vector, Length
vec2pt_46 = Vector2Pt(PointA=pt_78, PointB=pt_87, Unitize=False)  # -> Vector, Length
vec2pt_47 = Vector2Pt(PointA=pt_88, PointB=pt_95, Unitize=False)  # -> Vector, Length
vec2pt_48 = Vector2Pt(PointA=pt_92, PointB=pt_96, Unitize=False)  # -> Vector, Length

# ---- group: Geometry definition
panel = Panel("C:\Users\Nico\Desktop\PDS_light\Vitres_CEOUEST.xml")
panel_2 = Panel("C:\Users\romai\Desktop\PDS_light\Vitres_CEOUEST.xml")

# ----
entwine = Entwine(
    Branch00=pt_78,
    Branch01=pt_88,
    Branch02=pt_92,
    Branch03=pt_81,
    Branch04=pt_85,
    Branch05=pt_86,
    Branch06=pt_82,
    Branch07=pt_83,
    Branch08=pt_84,
    Branch09=pt_79,
    Branch010=pt_73,
    Branch011=pt_75,
    Branch012=pt_65,
    Branch013=pt_39,
    Branch014=pt_40,
    Branch015=pt_54,
    Branch016=pt_56,
    Branch017=pt_41,
    Branch018=pt_20,
    Branch019=pt_21,
    Branch020=pt_57,
    Branch021=pt_69,
    Branch022=pt_43,
    Branch023=pt_22,
    Branch024=pt,
    Branch025=pt_34,
    Branch026=pt_46,
    Branch027=pt_23,
    Branch028=pt_6,
    Branch029=pt_15,
    Branch030=pt_35,
    Branch031=pt_37,
    Branch032=pt_16,
    Branch033=pt_7,
    Branch034=pt_9,
    Branch035=pt_17,
    Branch036=pt_13,
    Branch037=pt_10,
    Branch038=pt_3,
    Branch039=pt_5,
    Branch040=pt_2,
    Branch041=pt_49,
    Branch042=pt_26,
    Branch043=pt_27,
    Branch044=pt_59,
    Branch045=pt_60,
    Branch046=pt_71,
    Branch047=pt_63,
    FlattenInputs=True)
entwine_2 = Entwine(
    Branch00=vec2pt_46.Vector,
    Branch01=vec2pt_47.Vector,
    Branch02=vec2pt_48.Vector,
    Branch03=vec2pt_38.Vector,
    Branch04=vec2pt_39.Vector,
    Branch05=vec2pt_44.Vector,
    Branch06=vec2pt_40.Vector,
    Branch07=vec2pt_41.Vector,
    Branch08=vec2pt_42.Vector,
    Branch09=vec2pt_45.Vector,
    Branch010=vec2pt_43.Vector,
    Branch011=vec2pt_37.Vector,
    Branch012=vec2pt_36.Vector,
    Branch013=vec2pt_29.Vector,
    Branch014=vec2pt_33.Vector,
    Branch015=vec2pt_31.Vector,
    Branch016=vec2pt_32.Vector,
    Branch017=vec2pt_26.Vector,
    Branch018=vec2pt_17.Vector,
    Branch019=vec2pt_23.Vector,
    Branch020=vec2pt_34.Vector,
    Branch021=vec2pt_35.Vector,
    Branch022=vec2pt_30.Vector,
    Branch023=vec2pt_20.Vector,
    Branch024=vec2pt_21.Vector,
    Branch025=vec2pt_27.Vector,
    Branch026=vec2pt_28.Vector,
    Branch027=vec2pt_22.Vector,
    Branch028=vec2pt_14.Vector,
    Branch029=vec2pt_18.Vector,
    Branch030=vec2pt_24.Vector,
    Branch031=vec2pt_25.Vector,
    Branch032=vec2pt_19.Vector,
    Branch033=vec2pt_12.Vector,
    Branch034=vec2pt_10.Vector,
    Branch035=vec2pt_15.Vector,
    Branch036=vec2pt_16.Vector,
    Branch037=vec2pt_13.Vector,
    Branch038=vec2pt_9.Vector,
    Branch039=vec2pt_11.Vector,
    Branch040=vec2pt_7.Vector,
    Branch041=vec2pt_3.Vector,
    Branch042=vec2pt.Vector,
    Branch043=vec2pt_2.Vector,
    Branch044=vec2pt_4.Vector,
    Branch045=vec2pt_5.Vector,
    Branch046=vec2pt_8.Vector,
    Branch047=vec2pt_6.Vector,
    FlattenInputs=True)
honeybee = Honeybee_Honeybee()  # -> Vviiiiiiiiiizzz; plug-in component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
# Be sure the base component are always there
ladybug = Ladybug_Ladybug()  # -> Vviiiiiiiiiizzz; plug-in component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
# center origin for the solar diagram
point = Point(Point(-501.3483233, 529.0865913, 0))

# ---- group: analysis surface
_2nd_floor = Geometry(<brep referenced from the Rhino model>)
_1st_floor = Geometry(<brep referenced from the Rhino model>)

# ---- group: Select view for annual glare
list = ValueList({"View 1": 0, "View 2": 1, "View 3": 2}, selected="View 1")

# ---- group: selected simulation recipe
list_2 = ValueList({"DF": 0, "Annual": 1, "Point in Time": 2, "DGP": 3, "Annual DGP": 4, "PIT H[+]": 5}, selected="Annual DGP")

# ---- group: PIT input
month = Panel("6")
hour = Panel("8")
day = Panel("21")

# ----
number_slider = Slider(2, range=0..10)
# leave this as is
panel_3 = Panel("""-ab 9
-ad 4096
-ar 30
-aa 0.15
-ds .1""")

# ---- group: radiance simulation parameters
radparameters = Honeybee_RADParameters(quality=number_slider, ab="9", ad="4096", ar="30", aa="0.15", additionalP="-ds .1")  # -> readMe, radParameters; plug-in component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
panel_4 = Panel(radparameters.readMe)

# ----
panel_5 = Panel("0")

# ---- group: Parallel to the facade (long)
pt_97 = Point(Point(-520.3742919, 337.7642091, 9.900029228))
pt_98 = Point(Point(-510.9169257, 330.4404366, 9.900029228))
vec2pt_49 = Vector2Pt(PointA=pt_98, PointB=pt_97, Unitize=False)  # -> Vector, Length

# ---- group: Parallel to the facade (high)
pt_99 = Point(Point(-361.5119612, 523.3707132, 9.900029228))
pt_100 = Point(Point(-361.5119612, 523.3707132, -1.889999713))
vec2pt_50 = Vector2Pt(PointA=pt_100, PointB=pt_99, Unitize=False)  # -> Vector, Length

# ----
filter = StreamFilter(Gate=list, Stream0="Glare 1", Stream1="Glare 2", Stream2="Glare 3.1")
gentestpts = Honeybee_GenerateTestPoints(testGeometry=_2nd_floor, gridSize=Slider(0.5, range=0..10), distBaseSrf=Slider(0.01, range=0..0.01), moveTestMesh=True)  # -> readMe, simplify(testPoints), simplify(ptsVectors), simplify(facesArea), simplify(mesh); plug-in component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
radpargridbased = HoneybeePlus_RadianceParametersGridBased(complexity=number_slider, recipe_type=number_slider, dmtx_opt_par=panel_3)  # -> report, rad_par, vmtx_par, dmtx_par, smtx_par; plug-in component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
dsparameters = Honeybee_DSParameters(RhinoViewsName=filter, dgp_imageSize=250, onlyRunGlareAnalysis=True)  # -> DSParameters; plug-in component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

# ---- group: Chose the player
list_3 = ValueList({"Nicolas": 0, "Romain": 1}, selected="Romain")

# ----
filter_2 = StreamFilter(Gate=list_3, Stream0=panel, Stream1=panel_2)
filter_3 = StreamFilter(
    Gate=list_3,
    Stream0="C:\Users\Nico\Desktop\PDS_light\Lausanne-hour.epw",
    Stream1="C:\Users\romai\Desktop\PDS_light\Lausanne-hour.epw")

# ---- group: weather file
path = FilePath(filter_3)

# ----
importepw = Ladybug_ImportEpw(epwFile=path)  # -> readMe, latitude, location, dryBulbTemperature, dewPointTemperature, relativeHumidity, windSpeed, windDirection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; plug-in component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
# optional Solar Diagram for PIT simulation
importlocation = Ladybug_ImportLocation(epwFile=path)  # -> location; plug-in component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
strnum = Ladybug_SeparateData(inputList=flatten(importepw.globalHorizontalIlluminance))  # -> numbers, strings; plug-in component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
pl = PlaneNormal(Origin=Point(0, 0, 0), ZAxis=vec2pt_49.Vector)

# ---- group: solar diagram
sunpath = Ladybug_SunPath(
    location=importlocation,
    hour=hour,
    day=day,
    month=month,
    timeStep=1,
    centerPt=point,
    sunPathScale=".1",
    dailyOrAnnualSunPath=True)  # -> readMe, sunVectors, sunAltitudes, sunAzimuths, port, sunSpheresMesh, sunPathCrvs, compassCrvs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; plug-in component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

# ----
xy = XYPlane(Origin=Point(0, 0, 0))
planesrf = PlaneSurface(Plane=pl, XSize=Domain(-10, 10), YSize=Domain(-10, 10))
grid_creation_log = Panel(gentestpts.readMe)
angle = Angle(VectorA=sunpath.sunVectors, VectorB=vec2pt_49.Vector, Plane=xy)  # -> Angle, Reflex
angle_2 = Angle(VectorA=sunpath.sunVectors, VectorB=vec2pt_50.Vector, Plane=planesrf)  # -> Angle, Reflex
genclimatebasedsky = Honeybee_GenerateClimateBasedSky(weatherFile=path, month=month, day=day, hour=hour)  # -> radiationValues, skyFilePath; plug-in component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
panel_6 = Panel(strnum.numbers)
wea = HoneybeePlus_WEAFromEPW(epw_file=path)  # -> wea; plug-in component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
deg = Degrees(Radians=angle.Angle)
deg_2 = Degrees(Radians=angle_2.Angle)
analysisgrid = HoneybeePlus_AnalysisGrid(test_points=gentestpts.testPoints, pts_vectors=gentestpts.ptsVectors)  # -> analysis_grid; plug-in component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
subtraction = Subtraction(A="360", B=deg)
subtraction_2 = Subtraction(A=deg_2, B="90")
genstandardciesky = Honeybee_GenerateStandardCIESky(weatherFile=path, month=month, day=day, hour=hour, skyType=0)  # -> skyFilePath; plug-in component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
climatebased = HoneybeePlus_ClimatebasedSky(wea=wea, month=month, day=day, hour=hour)  # -> sky; plug-in component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
panel_7 = Panel(subtraction)
panel_8 = Panel(subtraction_2)
Z = UnitZ(Factor=1)
multiplication = Multiplication(A=sunpath.sunVectors, B="100")
skymatrix = HoneybeePlus_SkyMatrix(north=0, wea=wea, density=1)  # -> skymtx; plug-in component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
vdis = VectorDisplay(Anchor=sunpath.sunPositions, Vector=multiplication)

# ---- group: Receipe
# simulation recipes on the menu
daylighfactorsimulation = Honeybee_DaylightFactorSimulation(
    testPoints=gentestpts.testPoints,
    ptsVectors=gentestpts.ptsVectors,
    uniformSky=False,
    radParameters=radparameters.radParameters)  # -> analysisRecipe; plug-in component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
annualdlrecipe = HoneybeePlus_AnnualDaylightRecipe(skymtx=skymatrix, analysis_grids=analysisgrid, analysis_type=0, reuse_dmtx=False)  # -> analysis_recipe; plug-in component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
gridbasedsimulation = Honeybee_GridBasedSimulation(
    skyFile=genclimatebasedsky.skyFilePath,
    testPoints=gentestpts.testPoints,
    ptsVectors=gentestpts.ptsVectors,
    simulationType=0,
    radParameters=radparameters.radParameters)  # -> analysisRecipe; plug-in component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
gridbasedrecipe = HoneybeePlus_GridBasedRecipe(sky=climatebased, analysis_grids=analysisgrid, analysis_type=0)  # -> analysis_recipe; plug-in component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
annualdaylightsimulation = Honeybee_AnnualDaylightSimulation(
    epwWeatherFile=path,
    testPoints=gentestpts.testPoints,
    ptsVectors=gentestpts.ptsVectors,
    radParameters=radparameters.radParameters,
    DSParameters=dsparameters)  # -> analysisRecipe; plug-in component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
imagebasedsimulation = Honeybee_ImageBasedSimulation(skyFile=genstandardciesky, cameraType="1", simulationType=2, radParameters=radparameters.radParameters, backupImages=0)  # -> analysisRecipe; plug-in component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

# ----
imagebasedrecipe = HoneybeePlus_ImageBasedRecipe(sky=climatebased, analysis_type=2)  # -> analysis_recipe; plug-in component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
toggle = BooleanToggle(False)
list_4 = ValueList({"Point 1": 0, "Point 2": 1, "Point 3": 2, "Point 4": 3, "Point 5": 4, "Point 6": 5, "Point 7": 6, "Point 8": 7, "Point 9": 8, "Point 10": 9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}, selected="Point 36": 35)
filter_4 = StreamFilter(
    Gate=list_4,
    Stream0=pt_78,
    Stream1=pt_88,
    Stream2=pt_92,
    Stream3=pt_81,
    Stream4=pt_85,
    Stream5=pt_86,
    Stream6=pt_82,
    Stream7=pt_83,
    Stream8=pt_84,
    Stream9=pt_79,
    Stream10=pt_73,
    Stream11=pt_75,
    Stream12=pt_65,
    Stream13=pt_39,
    Stream14=pt_40,
    Stream15=pt_54,
    Stream16=pt_56,
    Stream17=pt_41,
    Stream18=pt_20,
    Stream19=pt_21,
    Stream20=pt_57,
    Stream21=pt_69,
    Stream22=pt_43,
    Stream23=pt_22,
    Stream24=pt,
    Stream25=pt_34,
    Stream26=pt_46,
    Stream27=pt_23,
    Stream28=pt_6,
    Stream29=pt_15,
    Stream30=pt_35,
    Stream31=pt_37,
    Stream32=pt_16,
    Stream33=pt_7,
    Stream34=pt_9,
    Stream35=pt_17,
    Stream36=pt_13,
    Stream37=pt_10,
    Stream38=pt_3,
    Stream39=pt_5,
    Stream40=pt_2,
    Stream41=pt_49,
    Stream42=pt_26,
    Stream43=pt_27,
    Stream44=pt_59,
    Stream45=pt_60,
    Stream46=pt_71,
    Stream47=pt_63)
filter_5 = StreamFilter(
    Gate=list_4,
    Stream0=vec2pt_46.Vector,
    Stream1=vec2pt_47.Vector,
    Stream2=vec2pt_48.Vector,
    Stream3=vec2pt_38.Vector,
    Stream4=vec2pt_39.Vector,
    Stream5=vec2pt_44.Vector,
    Stream6=vec2pt_40.Vector,
    Stream7=vec2pt_41.Vector,
    Stream8=vec2pt_42.Vector,
    Stream9=vec2pt_45.Vector,
    Stream10=vec2pt_43.Vector,
    Stream11=vec2pt_37.Vector,
    Stream12=vec2pt_36.Vector,
    Stream13=vec2pt_29.Vector,
    Stream14=vec2pt_33.Vector,
    Stream15=vec2pt_31.Vector,
    Stream16=vec2pt_32.Vector,
    Stream17=vec2pt_26.Vector,
    Stream18=vec2pt_17.Vector,
    Stream19=vec2pt_23.Vector,
    Stream20=vec2pt_34.Vector,
    Stream21=vec2pt_35.Vector,
    Stream22=vec2pt_30.Vector,
    Stream23=vec2pt_20.Vector,
    Stream24=vec2pt_21.Vector,
    Stream25=vec2pt_27.Vector,
    Stream26=vec2pt_28.Vector,
    Stream27=vec2pt_22.Vector,
    Stream28=vec2pt_14.Vector,
    Stream29=vec2pt_18.Vector,
    Stream30=vec2pt_24.Vector,
    Stream31=vec2pt_25.Vector,
    Stream32=vec2pt_19.Vector,
    Stream33=vec2pt_12.Vector,
    Stream34=vec2pt_10.Vector,
    Stream35=vec2pt_15.Vector,
    Stream36=vec2pt_16.Vector,
    Stream37=vec2pt_13.Vector,
    Stream38=vec2pt_9.Vector,
    Stream39=vec2pt_11.Vector,
    Stream40=vec2pt_7.Vector,
    Stream41=vec2pt_3.Vector,
    Stream42=vec2pt.Vector,
    Stream43=vec2pt_2.Vector,
    Stream44=vec2pt_4.Vector,
    Stream45=vec2pt_5.Vector,
    Stream46=vec2pt_8.Vector,
    Stream47=vec2pt_6.Vector)
analysisgrid_2 = HoneybeePlus_AnalysisGrid(name="Horizontal", test_points=filter_4, pts_vectors=Z)  # -> analysis_grid; plug-in component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
analysisgrid_3 = HoneybeePlus_AnalysisGrid(test_points=filter_4, pts_vectors=filter_5)  # -> analysis_grid; plug-in component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
vdis_2 = VectorDisplay(Anchor=filter_4, Vector=Z)
annualdlrecipe_2 = HoneybeePlus_AnnualDaylightRecipe(skymtx=skymatrix, analysis_grids=analysisgrid_2, analysis_type=0, dmtx_par=radpargridbased.dmtx_par, reuse_dmtx=False)  # -> analysis_recipe; plug-in component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
annualdlrecipe_3 = HoneybeePlus_AnnualDaylightRecipe(skymtx=skymatrix, analysis_grids=analysisgrid_3, analysis_type=0, dmtx_par=radpargridbased.dmtx_par, reuse_dmtx=False)  # -> analysis_recipe; plug-in component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
vdis_3 = VectorDisplay(Anchor=filter_4, Vector=filter_5)
panel_9 = Panel("Vertical illuminance [lux]")
panel_10 = Panel("Horizontal Radiation [kWh]")
panel_11 = Panel("3")

# ---- group: Annual DGP Result 2nd Floor
panel_12 = Panel("C:\Users\romai\Desktop\PDS_light\unnamed\Glare_1\unnamed_0.dgp")
panel_13 = Panel("C:\Users\Nico\Desktop\PDS_light\unnamed\Glare_1\unnamed_0.dgp")
panel_14 = Panel("C:\Users\romai\Desktop\PDS_light\unnamed\Glare_2\unnamed_0.dgp")
panel_15 = Panel("C:\Users\Nico\Desktop\PDS_light\unnamed\Glare_2\unnamed_0.dgp")
panel_16 = Panel("C:\Users\Nico\Desktop\PDS_light\unnamed\Glare_3.1\unnamed_0.dgp")
panel_17 = Panel("C:\Users\romai\Desktop\PDS_light\unnamed\Glare_3.1\unnamed_0.dgp")
list_5 = ValueList({"View 1": 0, "View 2": 1, "View 3": 2}, selected="View 2")
filter_6 = StreamFilter(Gate=list_5, Stream0=panel_12, Stream1=panel_14, Stream2=panel_17)
filter_7 = StreamFilter(Gate=list_5, Stream0=panel_13, Stream1=panel_15, Stream2=panel_16)
filter_8 = StreamFilter(Gate=list_3, Stream0=filter_7, Stream1=filter_6)
path_2 = FilePath(filter_8)
importdgp = Honeybee_ImportDgpFile(dgpFile=path_2)  # -> viewPoints, viewDirections, dgpValues; plug-in component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
legendpar = Ladybug_LegendParameters(lowBound=Slider(0.3, range=0..1), highBound=Slider(0.45, range=0..1), numSegments="4")  # -> legendPar; plug-in component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
pt_101 = Point(Point(912.5, -10, 0.005))
_3dchart = Ladybug_3DChart(inputData=flatten(importdgp.dgpValues), basePoint=pt_101, xScale="0.25", zScale="0", legendPar=legendpar)  # -> readMe, graphMesh, graphCurves, legend, legendBasePts, title, titleBasePts, dataPts, conditionalHOY; plug-in component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
preview = CustomPreview(Geometry=_3dchart.graphCurves, Material=ColourSwatch(SwatchColor=RGB(0, 0, 0)))

# ---- group: DF results / Grid points 1st floor
panel_18 = Panel("C:\Users\Nico\Desktop\PDS_light\unnamed\DF_1st\unnamed_0.pts")
panel_19 = Panel("C:\Users\romai\Desktop\PDS_light\unnamed\DF_1st\unnamed_0.pts")

# ---- group: DF results / Results 1st floor
panel_20 = Panel("C:\Users\romai\Desktop\PDS_light\unnamed\DF_1st\unnamed_0.res")
panel_21 = Panel("C:\Users\Nico\Desktop\PDS_light\unnamed\DF_1st\unnamed_0.res")

# ---- group: DF results
filter_9 = StreamFilter(Gate=list_3, Stream0=panel_18, Stream1=panel_19)
filter_10 = StreamFilter(Gate=list_3, Stream0=panel_21, Stream1=panel_20)
path_3 = FilePath(filter_9)
path_4 = FilePath(filter_10)
importpts = Honeybee_ImportPtsFile(ptsFileAddress=path_3)  # -> points, vectors; plug-in component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
readradresults = Honeybee_ReadRADResult(analysisType="3", resultFiles=path_4, testPts=importpts.points, writeToFile=False)  # -> readMe, unit, values; plug-in component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
num = Number(readradresults.values)
df = BarGraph(readradresults.values, BarColor=RGB(255, 0, 90))
avr = Average(Input=num)
bnd = Bounds(Numbers=readradresults.values)
panel_22 = Panel(bnd)
av_df = Panel(avr)
toggle_2 = BooleanToggle(False)
toggle_3 = BooleanToggle(False)
toggle_4 = BooleanToggle(False)
toggle_5 = BooleanToggle(False)
toggle_6 = BooleanToggle(False)
toggle_7 = BooleanToggle(False)
toggle_8 = BooleanToggle(False)
toggle_9 = BooleanToggle(True)
toggle_10 = BooleanToggle(False)
toggle_11 = BooleanToggle(False)
toggle_12 = BooleanToggle(False)
toggle_13 = BooleanToggle(False)
toggle_14 = BooleanToggle(False)
toggle_15 = BooleanToggle(False)
toggle_16 = BooleanToggle(False)
cull = CullPattern(
    List=importpts.points,
    CullPattern=[toggle_9, toggle_10, toggle_11, toggle_12, toggle_13, toggle_14, toggle_15, toggle_16, toggle_2, toggle_3, toggle_4, toggle_5, toggle_6, toggle_7, toggle_8])
cull_2 = CullPattern(
    List=readradresults.values,
    CullPattern=[toggle_9, toggle_10, toggle_11, toggle_12, toggle_13, toggle_14, toggle_15, toggle_16, toggle_2, toggle_3, toggle_4, toggle_5, toggle_6, toggle_7, toggle_8])
col = Colour(RGB(0, 0, 0))
tag = TextTag3D(Location=cull, Text=cull_2, Size=Slider(0.6, range=0..1), Colour=col, Justification=7)

# ---- group: DF results / visualization
legend_title = Panel("[%]")
min = Panel("0")
max = Panel("10")
legendpar_2 = Ladybug_LegendParameters(lowBound=min, highBound=max, numSegments=Slider(10, range=0..100), decimalPlaces=Slider(0, range=0..100))  # -> legendPar; plug-in component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
legend_title_2 = Panel("DF")
recolormesh = Ladybug_RecolorMesh(
    analysisResult=readradresults.values,
    inputMesh=gentestpts.mesh,
    legendPar=legendpar_2,
    analysisTitle=legend_title_2,
    legendTitle=legend_title)  # -> readMe, newMesh, newLegend, legendBasePt, meshColors, legendColors; plug-in component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

# ----
strnum_2 = Ladybug_SeparateData(inputList=flatten(importdgp.dgpValues))  # -> numbers, strings; plug-in component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
panel_23 = Panel(strnum_2.numbers)
sort = SortList(Keys=strnum_2.numbers)  # -> Keys, ValuesA
panel_24 = Panel(sort.Keys)

# ---- group: Geometry definition
panel_25 = Panel("Glass")
path_5 = FilePath(filter_2)
radopaquemat3 = HoneybeePlus_RadianceOpaqueMaterial3(name="Brass", r_ref="0.726", g_ref="0.563", b_ref="0.223", spec="0", rough="0")  # -> material; plug-in component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
radopaquematerial = Honeybee_RadianceOpaqueMaterial(materialName="Brass", RReflectance="0.726", GReflectance="0.563", BReflectance="0.223", roughness="0", specularity="0")  # -> avrgRef, RADMaterial; plug-in component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
radopaquemat3_2 = HoneybeePlus_RadianceOpaqueMaterial3(name="Castor", r_ref="0.357", g_ref="0.314", b_ref="0.31", spec="0", rough="0")  # -> material; plug-in component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
radopaquematerial_2 = Honeybee_RadianceOpaqueMaterial(materialName="Castor", RReflectance="0.357", GReflectance="0.314", BReflectance="0.31", roughness="0", specularity="0")  # -> avrgRef, RADMaterial; plug-in component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
radopaquemat3_3 = HoneybeePlus_RadianceOpaqueMaterial3(name="Pure_white", r_ref="0.729", g_ref="0.899", b_ref="0.842", spec="0", rough="0")  # -> material; plug-in component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
radopaquematerial_3 = Honeybee_RadianceOpaqueMaterial(
    materialName="Pure_white",
    RReflectance="0.729",
    GReflectance="0.899",
    BReflectance="0.842",
    roughness="0",
    specularity="0")  # -> avrgRef, RADMaterial; plug-in component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
radopaquemat3_4 = HoneybeePlus_RadianceOpaqueMaterial3(name="White_roughcast", r_ref="0.726", g_ref="0.706", b_ref="0.633", spec="0", rough="0")  # -> material; plug-in component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
radopaquematerial_4 = Honeybee_RadianceOpaqueMaterial(
    materialName="White_roughcast",
    RReflectance="0.726",
    GReflectance="0.706",
    BReflectance="0.633",
    roughness="0",
    specularity="0")  # -> avrgRef, RADMaterial; plug-in component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
radopaquemat3_5 = HoneybeePlus_RadianceOpaqueMaterial3(name="RAL_7035_light_grey", r_ref="0.459", g_ref="0.598", b_ref="0.583", spec="0", rough="0")  # -> material; plug-in component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
radopaquematerial_5 = Honeybee_RadianceOpaqueMaterial(
    materialName="RAL_7035_light_grey",
    RReflectance="0.459",
    GReflectance="0.598",
    BReflectance="0.583",
    roughness="0",
    specularity="0")  # -> avrgRef, RADMaterial; plug-in component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
radopaquemat3_6 = HoneybeePlus_RadianceOpaqueMaterial3(name="RAL_7016_beige_grey", r_ref="0.027", g_ref="0.046", b_ref="0.053", spec="0", rough="0")  # -> material; plug-in component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
radopaquematerial_6 = Honeybee_RadianceOpaqueMaterial(
    materialName="RAL_7016_beige_grey",
    RReflectance="0.027",
    GReflectance="0.046",
    BReflectance="0.053",
    roughness="0",
    specularity="0")  # -> avrgRef, RADMaterial; plug-in component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
radbsdfmat = HoneybeePlus_RadianceBSDFMaterial(xmlfile=path_5, up_vec=Vector(0.01, 0.01, 1), thickness=0)  # -> material; plug-in component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
radbsdfmaterial = Honeybee_RadianceBSDFMaterial(materialName=panel_25, XMLFilePath=path_5, upOrientation=Vector(0.01, 0.01, 1), thickness=0)  # -> RADMaterial; plug-in component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
panel_26 = Panel(radbsdfmat)
srfattributelist = Honeybee_SurfaceAttributeList({"Name": "name", "Radiance Material": "RadMaterial", "EnergyPlus Construction": "EPConstruction", "Surface Type": "type", "Boundary Condition": "BC", "BC Object": "BCObject", "Sun Exposure": "sunExposure", "Wind Exposure": "windExposure", "Has Child Surface": "hasChild", "Is Child Surface": "isChild", "Is Planar": "isPlanar", "Srf Type Set By User": "srfTypeByUser", "Boundary Condition Set By User": "srfBCByUser", "Shade Material Name": "shadeMaterialName", "Shading Control Name": "shadingControlName", "Shcading Schedule Name": "shadingSchName"}, selected="Radiance Material")
mesh = Mesh([<mesh referenced from the Rhino model> x27])
srf = Surface([<surface referenced from the Rhino model> x296])
mesh_2 = Mesh([<mesh referenced from the Rhino model> x5000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])
mesh_3 = Mesh([<mesh referenced from the Rhino model> x222])
mesh_4 = Mesh([<mesh referenced from the Rhino model> x2124])
mesh_5 = Mesh([<mesh referenced from the Rhino model> x195])
geo = Geometry([<brep referenced from the Rhino model> x2])
mesh_6 = Mesh([<mesh referenced from the Rhino model> x288])
mesh_7 = Mesh([<mesh referenced from the Rhino model> x834])
createhbsrfs = Honeybee_createHBSrfs(geometry=mesh, srfName="Ceiling", RADMaterial=radopaquematerial_3.RADMaterial)  # -> readMe, simplify(HBSurface); plug-in component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
hbsurface = HoneybeePlus_HoneybeeSurface(geo=mesh_4, names="External_beams", rad_mat=radopaquemat3)  # -> report, HB_srf; plug-in component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
createhbsrfs_2 = Honeybee_createHBSrfs(geometry=mesh_4, srfName="External_beams", RADMaterial=radopaquematerial.RADMaterial)  # -> readMe, simplify(HBSurface); plug-in component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
hbsurface_2 = HoneybeePlus_HoneybeeSurface(geo=mesh_5, names="Floor", rad_mat=radopaquemat3_2)  # -> report, HB_srf; plug-in component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
createhbsrfs_3 = Honeybee_createHBSrfs(geometry=mesh_5, srfName="Floor", RADMaterial=radopaquematerial_2.RADMaterial)  # -> readMe, simplify(HBSurface); plug-in component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
hbsurface_3 = HoneybeePlus_HoneybeeSurface(geo=mesh_7, names="internal_walls", rad_mat=radopaquemat3_4)  # -> report, HB_srf; plug-in component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
createhbsrfs_4 = Honeybee_createHBSrfs(geometry=mesh_7, srfName="internal_walls", RADMaterial=radopaquematerial_4.RADMaterial)  # -> readMe, simplify(HBSurface); plug-in component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
hbsurface_4 = HoneybeePlus_HoneybeeSurface(geo=mesh_6, names="Internal_columns", rad_mat=radopaquemat3_4)  # -> report, HB_srf; plug-in component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
createhbsrfs_5 = Honeybee_createHBSrfs(geometry=mesh_6, srfName="Internal_columns", RADMaterial=radopaquematerial_4.RADMaterial)  # -> readMe, simplify(HBSurface); plug-in component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
hbsurface_5 = HoneybeePlus_HoneybeeSurface(geo=mesh_3, names="Offices", rad_mat=radopaquemat3_5)  # -> report, HB_srf; plug-in component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
createhbsrfs_6 = Honeybee_createHBSrfs(geometry=mesh_3, srfName="Offices", RADMaterial=radopaquematerial_5.RADMaterial)  # -> readMe, simplify(HBSurface); plug-in component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
hbsurface_6 = HoneybeePlus_HoneybeeSurface(geo=mesh_2, names="Offices_background", rad_mat=radopaquemat3_6)  # -> report, HB_srf; plug-in component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
createhbsrfs_7 = Honeybee_createHBSrfs(geometry=mesh_2, srfName="Offices_background", RADMaterial=radopaquematerial_6.RADMaterial)  # -> readMe, simplify(HBSurface); plug-in component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
hbsurface_7 = HoneybeePlus_HoneybeeSurface(geo=mesh, names="Ceiling", rad_mat=radopaquemat3_3)  # -> report, HB_srf; plug-in component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
hbwinsrf = HoneybeePlus_HoneybeeWindowSurface(geo=geo, names="Glass", rad_mat=radbsdfmat)  # -> report, HB_win_srf; plug-in component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
panel_27 = Panel(hbsurface.HB_srf)
panel_28 = Panel(createhbsrfs_3.readMe)
panel_29 = Panel(createhbsrfs.readMe)
panel_30 = Panel(createhbsrfs_7.readMe)
panel_31 = Panel(createhbsrfs_5.readMe)
panel_32 = Panel(createhbsrfs_4.readMe)
panel_33 = Panel(createhbsrfs_6.readMe)

# ----
radglassmaterial = Honeybee_RadianceGlassMaterial(materialName=panel_25, RTransmittance="0.69", GTransmittance="0.69", BTransmittance="0.69", refractiveIndex=1.52)  # -> avrgTrans, RADMaterial; plug-in component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

# ---- group: Geometry definition (continued)
createhbsrfs_8 = Honeybee_createHBSrfs(geometry=geo, srfName="Glass", RADMaterial=radglassmaterial.RADMaterial)  # -> readMe, simplify(HBSurface); plug-in component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
labelsurfaces = Honeybee_LabelZoneSurfaces(HBObjects=flatten(createhbsrfs_8.HBSurface), attribute=srfattributelist)  # -> surfaceTxtLabels, labelBasePts, brepTxtLabels, surfaceWireFrames; plug-in component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
panel_34 = Panel(labelsurfaces.surfaceTxtLabels)

# ---- group: honeybee surfaces with windows holes and assigned radiance materials
entwine_3 = Entwine(
    Branch00=createhbsrfs_2.HBSurface,
    Branch01=createhbsrfs_3.HBSurface,
    Branch02=createhbsrfs.HBSurface,
    Branch03=createhbsrfs_4.HBSurface,
    Branch04=createhbsrfs_5.HBSurface,
    Branch05=createhbsrfs_6.HBSurface,
    Branch06=createhbsrfs_7.HBSurface,
    Branch07=createhbsrfs_8.HBSurface,
    FlattenInputs=True)
# 1. MAIN INPUT
entwine_4 = Entwine(
    Branch00=hbsurface.HB_srf,
    Branch01=hbsurface_2.HB_srf,
    Branch02=hbsurface_7.HB_srf,
    Branch03=hbsurface_3.HB_srf,
    Branch04=hbsurface_4.HB_srf,
    Branch05=hbsurface_5.HB_srf,
    Branch06=hbsurface_6.HB_srf,
    Branch08=hbwinsrf.HB_win_srf,
    FlattenInputs=True)

# ---- group: working directory
panel_35 = Panel("C:\Users\romai\Desktop\PDS_light")
# 2. SIMULATION SET-UP
panel_36 = Panel("C:\Users\Nico\Desktop\PDS_light")

# ----
start_simulation = BooleanToggle(True)
filter_11 = StreamFilter(
    Gate=list_2,
    Stream0=daylighfactorsimulation,
    Stream1=annualdlrecipe,
    Stream2=gridbasedsimulation,
    Stream3=imagebasedsimulation,
    Stream4=annualdaylightsimulation,
    Stream5=gridbasedrecipe)
filter_12 = StreamFilter(Gate=list_3, Stream0=panel_36, Stream1=panel_35)
gate = StreamGate(Stream=filter_11, Gate=list_2)  # -> Target0, Target1, Target2, Target3, Target4, Target5

# ---- group: working directory (continued)
path_6 = FilePath(filter_12)

# ----
runradiance = HoneybeePlus_RunRadianceAnalysis(analysis_recipe=annualdlrecipe_2, HB_objects=entwine_4, folder=path_6, name="Horizontal", write=toggle, run=toggle)  # -> report, legend_par, outputs; plug-in component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
runradiance_2 = HoneybeePlus_RunRadianceAnalysis(analysis_recipe=annualdlrecipe_3, HB_objects=entwine_4, folder=path_6, name="Vertical", write=toggle, run=toggle)  # -> report, legend_par, outputs; plug-in component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
rundaylightanalysis = Honeybee_RunDaylightSimulation(
    HBObjects=flatten(entwine_3),
    analysisRecipe=[gate.Target2, gate.Target0, gate.Target3, gate.Target4],
    writeRad=start_simulation,
    runRad=start_simulation,
    workingDir=path_6,
    meshSettings=gentestpts.mesh,
    overwriteResults=True)  # -> readMe, analysisType, resultsUnit, dgp_values, testPts, annual_analysis_files, radGeoFile, studyFolder, done; plug-in component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
runradiance_3 = HoneybeePlus_RunRadianceAnalysis(
    analysis_recipe=[gate.Target1, gate.Target5],
    HB_objects=entwine_4,
    folder=path_6,
    name="untitled",
    write=start_simulation,
    run=start_simulation)  # -> report, legend_par, outputs; plug-in component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

glareanalysis = Honeybee_GlareAnalysis(HDRImagePath=rundaylightanalysis.annual_analysis_files, runIt=Toggle(True))  # -> readMe, glareCheckImage, DGP, DGI, glareComfortRange, imageWithTaskArea; plug-in component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
panel_37 = Panel(glareanalysis.glareComfortRange)
hdr_tif = Honeybee_ConvertHDRToTIF(HDRFilePath=glareanalysis.glareCheckImage, adjustExposure=Toggle(True))  # -> TIFFFilePath; plug-in component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

readradresults_2 = Honeybee_ReadRADResult(
    analysisType=rundaylightanalysis.analysisType,
    resultFiles=rundaylightanalysis.annual_analysis_files,
    testPts=rundaylightanalysis.testPts,
    writeToFile=False)  # -> readMe, unit, values; plug-in component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

falsecolor = Honeybee_FalseColor(
    HDRFilePath=rundaylightanalysis.annual_analysis_files,
    legendUnit="cd/m2",
    legendMax="20000",
    contourBands=False,
    maskThreshold=0.1,
    useAlterColors=False,
    render=Toggle(True))  # -> outputFilePath; plug-in component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

panel_38 = Panel(rundaylightanalysis.dgp_values)
sensor = HoneybeePlus_SensorFromAnalysisGrid(analysis_grid=runradiance.outputs, index=0)  # -> position, sensor; plug-in component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
sensor_2 = HoneybeePlus_SensorFromAnalysisGrid(analysis_grid=runradiance_2.outputs, index=0)  # -> position, sensor; plug-in component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
senhourlyvalues = HoneybeePlus_SensorHourlyValues(sensor=sensor.sensor)  # -> report, values; plug-in component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
senhourlyvalues_2 = HoneybeePlus_SensorHourlyValues(sensor=sensor_2.sensor)  # -> report, values; plug-in component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

# ---- group: output 1
bnd_2 = Bounds(Numbers=readradresults_2.values)
num_2 = Number(readradresults_2.values)
avr_2 = Average(Input=num_2)
df_value_range = Panel(bnd_2)
av_df_2 = Panel(avr_2)
df_2 = BarGraph(readradresults_2.values, BarColor=RGB(255, 0, 90))

# ----
panel_39 = Panel(readradresults_2.values)
panel_40 = Panel(glareanalysis.DGI)
hdr_tif_2 = Honeybee_ConvertHDRToTIF(HDRFilePath=falsecolor, adjustExposure=False)  # -> TIFFFilePath; plug-in component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
branch = TreeBranch(Tree=senhourlyvalues.values, Path="{0;0;0;0}", MaintainPaths=True)
branch_2 = TreeBranch(Tree=senhourlyvalues_2.values, Path="{0;0;0;0}", MaintainPaths=True)
panel_41 = Panel(senhourlyvalues.values)
panel_42 = Panel(senhourlyvalues_2.values)
imageviewer = Ladybug_ImageViewer(ImagePath_=hdr_tif_2, _scale_=1, DisableClickable=False, SaveImgWithCoords=False, scale=1)  # -> ImagePath, Values, GIF

imageviewer_2 = Ladybug_ImageViewer(ImagePath_=hdr_tif, _scale_=Slider(1, range=0..1), DisableClickable=False, SaveImgWithCoords=False, scale=1)  # -> ImagePath, Values, GIF

panel_43 = Panel(imageviewer_2.GIF)
xyplot = XYPlot(
    Type=0,
    Width=550,
    Height=450,
    X_title=panel_10,
    Y_title=panel_9,
    X_data=senhourlyvalues.values,
    X_rot=0,
    Y_data=senhourlyvalues.values,
    Show_xgrid=False,
    Show_ygrid=True,
    Legend=0)
xyplot_2 = XYPlot(
    Type=0,
    Width=550,
    Height=450,
    X_title=panel_10,
    Y_title=panel_9,
    X_data=branch_2,
    X_rot=0,
    Y_data=senhourlyvalues_2.values,
    Show_xgrid=False,
    Show_ygrid=True,
    Legend=0)

# ---- group: Annual Glare
legendpar_3 = Ladybug_LegendParameters(lowBound=Slider(0.3, range=0..1), highBound=Slider(0.45, range=0..1), numSegments="4")  # -> legendPar; plug-in component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
pt_102 = Point(Point(912.5, -10, 0.005))
_3dchart_2 = Ladybug_3DChart(inputData=flatten(rundaylightanalysis.dgp_values), basePoint=pt_102, xScale="0.25", zScale="0", legendPar=legendpar_3)  # -> readMe, graphMesh, graphCurves, legend, legendBasePts, title, titleBasePts, dataPts, conditionalHOY; plug-in component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
preview_2 = CustomPreview(Geometry=_3dchart_2.graphCurves, Material=ColourSwatch(SwatchColor=RGB(0, 0, 0)))

# ----
hourlyvalues = HoneybeePlus_HourlyValues(analysis_grid=runradiance_3.outputs)  # -> report, values; plug-in component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
occscheduleweek = HoneybeePlus_OccupancyScheduleFromWeek(def_value=1)  # -> schedule, values; plug-in component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
list_6 = ValueList({"100 lux": 0, "300 lux": 1, "500 lux": 2, "750 lux": 3}, selected="300 lux")
filter_13 = StreamFilter(Gate=list_6, Stream0="100", Stream1="300", Stream2="500", Stream3="750")
value_list = ValueList({"DA": 0, "sDA": 1, "cDA": 2, "UDI": 3, "UDI_less": 4, "UDI_more": 5, "PIT": 6}, selected="UDI")

annualmetrics = HoneybeePlus_AnnualDaylightMetrics(analysis_grid=runradiance_3.outputs, occ_schedule=occscheduleweek.schedule, threshold=filter_13)  # -> report, DA, CDA, UDI, UDI_less, UDI_more, legend_par; plug-in component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
sda = HoneybeePlus_SpatialDaylightAutonomy(analysis_grid=runradiance_3.outputs, threshold=filter_13, target_DA=50)  # -> report, sDA, DA, prblm_pts; plug-in component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

stream_filter = StreamFilter(
    Gate=value_list,
    Stream0=annualmetrics.DA,
    Stream1=sda.sDA,
    Stream2=annualmetrics.CDA,
    Stream3=annualmetrics.UDI,
    Stream4=annualmetrics.UDI_less,
    Stream5=annualmetrics.UDI_more,
    Stream6=hourlyvalues.values)
num_3 = Number(stream_filter)
bnd_3 = Bounds(Numbers=stream_filter)
avr_3 = Average(Input=num_3)
ghpython_script = GhPythonScript(active=Toggle(True), L=stream_filter, after=Slider(2, range=0..10))  # -> out, R, active; inputs L: list, after: Int32
# ---------- ghpython_script: Python ----------
if active:

    L = [(eval("'{:0" + str(after+1) + "." + str(after) +"f}'.format(float(" + str(num) + "))")) for num in L]

    R = L

    active = True
else:
    active = False
# ---------- end ghpython_script ----------
av_da = Panel(avr_3)
da_value_range = Panel(bnd_3)

filter_14 = StreamFilter(
    Gate=list_2,
    Stream0=readradresults_2.values,
    Stream1=ghpython_script.R,
    Stream2=readradresults_2.values,
    Stream5=ghpython_script.R)

# ---- group: visualization
max_2 = Panel("2000")
max_3 = Panel("1200")
# 6. SET VISUALIZATION SETTINGS
legend_title_3 = Panel("lux")
legend_title_4 = Panel("[%]")
min_2 = Panel("0")
max_4 = Panel("10")
filter_15 = StreamFilter(Gate=list_2, Stream0=max_4, Stream1=max_3, Stream2=max_2, Stream5=max_3)
legendpar_4 = Ladybug_LegendParameters(lowBound=min_2, highBound=filter_15, numSegments=Slider(11, range=0..100), decimalPlaces=Slider(0, range=0..100))  # -> legendPar; plug-in component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
filter_16 = StreamFilter(Gate=list_6, Stream0="cDA 100lx", Stream1="cDA 300lx", Stream2="cDA 500lx", Stream3="cDA 750lx")
filter_17 = StreamFilter(Gate=list_2, Stream0=legend_title_4, Stream1=legend_title_4, Stream2=legend_title_3, Stream5=legend_title_3)
filter_18 = StreamFilter(Gate=list_2, Stream0="DF", Stream1=filter_16, Stream2="Illuminance", Stream5="Illuminance")
recolormesh_2 = Ladybug_RecolorMesh(
    analysisResult=filter_14,
    inputMesh=gentestpts.mesh,
    legendPar=legendpar_4,
    analysisTitle=filter_18,
    legendTitle=filter_17)  # -> readMe, newMesh, newLegend, legendBasePt, meshColors, legendColors; plug-in component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
toggle_17 = BooleanToggle(False)
toggle_18 = BooleanToggle(False)
toggle_19 = BooleanToggle(False)
toggle_20 = BooleanToggle(False)
toggle_21 = BooleanToggle(False)
toggle_22 = BooleanToggle(False)
toggle_23 = BooleanToggle(False)
toggle_24 = BooleanToggle(True)
toggle_25 = BooleanToggle(False)
toggle_26 = BooleanToggle(False)
toggle_27 = BooleanToggle(False)
toggle_28 = BooleanToggle(False)
toggle_29 = BooleanToggle(False)
toggle_30 = BooleanToggle(False)
toggle_31 = BooleanToggle(False)
cull_3 = CullPattern(
    List=gentestpts.testPoints,
    CullPattern=[toggle_24, toggle_25, toggle_26, toggle_27, toggle_28, toggle_29, toggle_30, toggle_31, toggle_17, toggle_18, toggle_19, toggle_20, toggle_21, toggle_22, toggle_23])
cull_4 = CullPattern(
    List=filter_14,
    CullPattern=[toggle_24, toggle_25, toggle_26, toggle_27, toggle_28, toggle_29, toggle_30, toggle_31, toggle_17, toggle_18, toggle_19, toggle_20, toggle_21, toggle_22, toggle_23])
col_2 = Colour(RGB(0, 0, 0))
tag_2 = TextTag3D(Location=cull_3, Text=cull_4, Size=Slider(0.6, range=0..1), Colour=col_2, Justification=7)

# ----
visualization_log = Panel(recolormesh_2.readMe)
