# Grasshopper definition radiation.gh (Grasshopper 0.9.76)
# plug-ins: Python Interpreter

ladybug = Ladybug_Ladybug()  # -> Vviiiiiiiiiizzz; plug-in component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
run = BooleanToggle(True)
mesh = Mesh([<mesh referenced from the Rhino model> x86])
mesh_2 = Mesh([<mesh referenced from the Rhino model> x46])
path = FilePath("C:\Users\Pietro.000\Desktop\Venise\ITA_Venezia-Tessera.161050_IGDG.epw")
gencumulativeskymtx = Ladybug_GenCumulativeSkyMtx(epwFile=path, skyDensity=0, useOldRes=True, runIt=Toggle(True))  # -> readMe, cumulativeSkyMtx; plug-in component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
analysisperiod = Ladybug_AnalysisPeriod(fromMonth="1", fromDay="1", fromHour="1", toMonth="12", toDay="31", toHour="24")  # -> readMe, analysisPeriod; plug-in component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
cluster = Cluster(C=mesh_2)
selectskymtx = Ladybug_selectSkyMtx(
    cumulativeSkyMtx=gencumulativeskymtx.cumulativeSkyMtx,
    analysisPeriod=analysisperiod.analysisPeriod,
    removeDiffuse=False,
    removeDirect=False)  # -> readMe, selectedSkyMtx; plug-in component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
gradientlibrary = Ladybug_GradientLibrary(gradIndex=Slider(0, range=0..100))  # -> customColors; plug-in component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
legendpar = Ladybug_LegendParameters(lowBound=Slider(0, range=0..100), highBound=Slider(1500, range=0..10000), customColors=flatten(gradientlibrary))  # -> legendPar; plug-in component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
radiationanalysis = Ladybug_RadiationAnalysis(
    geometry=flatten([cluster, mesh_2]),
    context=flatten([mesh_2, mesh]),
    gridSize=Slider(5, range=0..10),
    disFromBase=Slider(0.1, range=0..0.1),
    selectedSkyMtx=flatten(selectskymtx.selectedSkyMtx),
    legendPar=flatten(legendpar),
    parallel=Toggle(True),
    runIt=run)  # -> readMe, contextMesh, analysisMesh, testPts, testVec, port, radiationResult, radiationMesh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; plug-in component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

# ==== cluster Cluster
C = ClusterInput()
bbox = BoundingBox(Content=C, Plane=PlaneXY(0, 0, 0), UnionBox=True)  # -> Box, Box_2
debrep = DeconstructBrep(Brep=bbox.Box)  # -> Faces, Edges, Vertices
area = Area(Geometry=debrep.Faces)  # -> Area, Centroid
pdecon = Deconstruct(Point=area.Centroid)  # -> XComponent, YComponent, ZComponent
bnd = Bounds(Numbers=pdecon.ZComponent)
dedomain = DeconstructDomain(Domain=bnd)  # -> Start, End
equals = Equality(FirstNumber=pdecon.ZComponent, SecondNumber=dedomain.Start)  # -> Equality, Inequality
cull = CullPattern(List=debrep.Faces, CullPattern=equals.Equality)
flip = Flip(Surface=cull)  # -> Surface, Result
S = ClusterOutput(flip.Surface)
