# Grasshopper definition shading.gh (Grasshopper 0.9.76)
# plug-ins: Python Interpreter

ladybug = Ladybug_Ladybug()  # -> Vviiiiiiiiiizzz; plug-in component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
run = BooleanToggle(True)
mesh = Mesh([<mesh referenced from the Rhino model> x132])
path = FilePath("C:\Users\Pietro.000\Desktop\Venise\ITA_Venezia-Tessera.161050_IGDG.epw")
panel = Panel("""12
9
6""")
importlocation = Ladybug_ImportLocation(epwFile=path)  # -> location; plug-in component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
sunpath = Ladybug_SunPath(location=importlocation, hour=12, day=21, month=panel, timeStep=1, dailyOrAnnualSunPath=True)  # -> readMe, sunVectors, sunAltitudes, sunAzimuths, port, sunSpheresMesh, sunPathCrvs, compassCrvs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; plug-in component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
cluster = Cluster(C=mesh)
lng = ListLength(List=sunpath.sunVectors)
addition = Addition(A=lng, B=1)
gradientlibrary = Ladybug_GradientLibrary(gradIndex=Slider(5, range=0..100))  # -> customColors; plug-in component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
number_slider = Slider(4, range=0..10)
legendpar = Ladybug_LegendParameters(numSegments=addition, customColors=flatten(gradientlibrary))  # -> legendPar; plug-in component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
sunlighthoursanalysis = Ladybug_SunlightHoursAnalysis(
    geometry=flatten(cluster),
    context=flatten(mesh),
    gridSize=Slider(1, range=0..10),
    disFromBase=Slider(0.1, range=0..0.1),
    sunVectors=flatten(sunpath.sunVectors),
    timeStep=1,
    legendPar=flatten(legendpar),
    parallel=Toggle(True),
    runIt=run)  # -> readMe, contextMesh, analysisMesh, testPts, testVec, port, sunlightHoursResult, sunlightHoursMesh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; plug-in component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

# ==== cluster Cluster
C = ClusterInput()
bbox = BoundingBox(Content=C, Plane=PlaneXY(0, 0, 0), UnionBox=True)  # -> Box, Box_2
debrep = DeconstructBrep(Brep=bbox.Box)  # -> Faces, Edges, Vertices
area = Area(Geometry=debrep.Faces)  # -> Area, Centroid
pdecon = Deconstruct(Point=area.Centroid)  # -> XComponent, YComponent, ZComponent
bnd = Bounds(Numbers=pdecon.ZComponent)
dedomain = DeconstructDomain(Domain=bnd)  # -> Start, End
equals = Equality(FirstNumber=pdecon.ZComponent, SecondNumber=dedomain.Start)  # -> Equality, Inequality
cull = CullPattern(List=debrep.Faces, CullPattern=equals.Equality)
flip = Flip(Surface=cull)  # -> Surface, Result
S = ClusterOutput(flip.Surface)
